# Grasshopper definition 0_tool_overview.gh (Grasshopper 1.0.7)
# plug-ins: Bifocals, ChopChop

chopchop = ChopChop()
rectangle = Rectangle({Plane=PlaneXY(3.063565428, 9.938408182, 0), Size=Domain2(u=-10.19163761..10.19163761, v=-7.221345511..7.221345511)})
# 绘制两点之间的垂直平分线，然后求得这些线所围成的最小集合多边形。
# （Voronoi多边形）
populate_2d = Populate2D(Region=rectangle, Count=Slider(20, range=0..100), Seed=Slider(50, range=0..100))
voronoi = Voronoi(Points=populate_2d, BruteForceOverride=False)
offset_curve = OffsetCurve(Curve=voronoi, Distance=Slider(-0.5, range=-1..1), Corners=1)
