# Grasshopper definition 1_PartA_Level1_00.gh (Grasshopper 1.0.7)

# 生成思维
number_slider = Slider(35, range=0..100)
# SqGrid
square = Square(Plane=PlaneXY(0, 0, 0), Size=1, ExtentX=number_slider, ExtentY=Slider(20, range=0..100))  # -> flatten(Cells), Points
list_length = ListLength(List=flatten(square.Cells))
area = Area(Geometry=square.Cells)  # -> Area, Centroid
random = Random(Range=Domain(0, 1), Number=list_length, Seed=2)
scale = Scale(Geometry=square.Cells, Center=area.Centroid, Factor=random)  # -> Geometry, Transform
boundary_surfaces = BoundarySurfaces(Edges=scale.Geometry)
