# Grasshopper definition 1_PartA_Level1_01逻辑构成.gh (Grasshopper 1.0.7)

# ---- group: Frame 网架
# 生成思维：逻辑构成
number_slider = Slider(35, range=0..100)
square = Square(Plane=PlaneXY(0, 0, 0), Size=1, ExtentX=number_slider, ExtentY=Slider(20, range=0..100))  # -> flatten(Cells), Points
curve = Curve(square.Cells)

# ---- group: Variate 变量
list_length = ListLength(List=flatten(square.Cells))
random = Random(Range=Domain(0, 1), Number=list_length, Seed=2)

# ---- group: Unit 单元
curve_2 = Curve(curve)
area = Area(Geometry=curve_2)  # -> Area, Centroid
scale = Scale(Geometry=curve_2, Center=area.Centroid, Factor=random)  # -> Geometry, Transform
boundary_surfaces = BoundarySurfaces(Edges=scale.Geometry)
