# Grasshopper definition 1_PartA_Level1_02_拓展C.gh (Grasshopper 1.0.7)

# ---- group: Frame 网架
# 练习：改变单元逻辑
number_slider = Slider(35, range=0..100)
square = Square(Plane=PlaneXY(0, 0, 0), Size=1, ExtentX=number_slider, ExtentY=Slider(20, range=0..100))  # -> flatten(Cells), Points
curve = Curve(square.Cells)

# ---- group: Variate 变量
list_length = ListLength(List=flatten(square.Cells))
random = Random(Range=Domain(0, 1), Number=list_length, Seed=2)

# ---- group: Unit 单元
curve_2 = Curve(curve)
area = Area(Geometry=curve_2)  # -> Area, Centroid
scale = Scale(Geometry=curve_2, Center=area.Centroid, Factor=random)  # -> Geometry, Transform
boundary_surfaces = BoundarySurfaces(Edges=scale.Geometry)

# ---- group: 拓展C
# extrude：将随机大小的平面向上拉伸成体块
# Base：拉伸的面
# Direction：拉伸的方向和距离
# 设置Z轴方向的矢量
# Factor输入矢量大小
unit_z = UnitZ(Factor=random)
boundary_surfaces_2 = BoundarySurfaces(Edges=boundary_surfaces)
extrude = Extrude(Base=boundary_surfaces_2, Direction=unit_z)
