# Grasshopper definition 1_PartA_Level1_03_拓展B.gh (Grasshopper 1.0.7)

# ---- group: Frame 网架
# 练习：改变单元逻辑
number_slider = Slider(35, range=0..100)
square = Square(Plane=PlaneXY(0, 0, 0), Size=1, ExtentX=number_slider, ExtentY=Slider(20, range=0..100))  # -> flatten(Cells), Points
curve = Curve(square.Cells)

# ---- group: Variate 变量
list_length = ListLength(List=flatten(square.Cells))
random = Random(Range=Domain(0, 1), Number=list_length, Seed=2)

# ---- group: Unit 单元
curve_2 = Curve(curve)
area = Area(Geometry=curve_2)  # -> Area, Centroid
scale = Scale(Geometry=curve_2, Center=area.Centroid, Factor=random)  # -> Geometry, Transform
boundary_surfaces = BoundarySurfaces(Edges=scale.Geometry)

# ---- group: 拓展B
# （1）数据分组
# 每个单元内的正方形和同一个单元内的缩放正方形分为一组，右键拍平。
# （2）封口命令
# 自动封闭形成环形，把中间的洞口流出。
# （3）之后同拓展C的内容。
graft_tree = GraftTree(Tree=flatten(curve_2), IncludeEmptyLists=True, IncludeNullItems=True)
graft_tree_2 = GraftTree(Tree=flatten(scale.Geometry), IncludeEmptyLists=True, IncludeNullItems=True)
unit_z = UnitZ(Factor="0.01")
boundary_surfaces_2 = BoundarySurfaces(Edges=[graft_tree_2, graft_tree])
extrude = Extrude(Base=boundary_surfaces_2, Direction=unit_z)
