# Grasshopper definition 1_PartA_Level1_04_拓展A.gh (Grasshopper 1.0.7)

# ---- group: Frame 网架
# 练习：改变单元逻辑
number_slider = Slider(35, range=0..100)
square = Square(Plane=PlaneXY(0, 0, 0), Size=1, ExtentX=number_slider, ExtentY=Slider(20, range=0..100))  # -> flatten(Cells), Points
curve = Curve(square.Cells)

# ---- group: Variate 变量
list_length = ListLength(List=flatten(square.Cells))
random = Random(Range=Domain(0, 1), Number=list_length, Seed=2)

# ---- group: Unit 单元
curve_2 = Curve(curve)
area = Area(Geometry=curve_2)  # -> Area, Centroid
scale = Scale(Geometry=curve_2, Center=area.Centroid, Factor=random)  # -> Geometry, Transform
boundary_surfaces = BoundarySurfaces(Edges=scale.Geometry)

# ---- group: 拓展A
# （1）Deconstruct Brep 从随机线框提取四个顶点
# （2）Interpolate：穿过这四个顶点连线；Periodic-Set Boolean-true：闭合成环
# （3）Boundary Surfaces：圆环封面
deconstruct_brep = DeconstructBrep(Brep=scale.Geometry)  # -> Faces, Edges, Vertices
interpolate = Interpolate(Vertices=deconstruct_brep.Vertices, Degree=3, Periodic=True, KnotStyle=1)  # -> Curve, Length, Domain
boundary_surfaces_2 = BoundarySurfaces(Edges=interpolate.Curve)
