# Grasshopper definition 1_PartA_Level2_01.gh (Grasshopper 1.0.7)

# ---- group: Frame 网架
# 生成思维 PartA Level2：slider的使用 + t值与曲线重新定义
# 重新定义曲线区间（Reparameterize）: 我们给Nurbs函数带入x坐标，即可以求得函数曲线上y、z坐标。
# 所以也可以把函数曲线看成是空间上一点的运动轨迹，t值就是曲线上一点的运动坐标，完整区间内的t值即代表了曲线上的任意一点。
# 往往我们绘制一条曲线之后，会发现它的t值区间很不一样。有的是（0to3），有的是（0to5）。这样很难给这些曲线同时匹配合理的t值。所以我们用Reparameterize 将完整曲线t值区间统一定义为（0to1），即（0％to 100％）。这样t值取0.5的时候，得到的就都是中间点了。
number_slider = Slider(35, range=0..100)
sqgrid = Square(Plane=PlaneXY(0, 0, 0), Size=1, ExtentX=number_slider, ExtentY=Slider(20, range=0..100))  # -> flatten(Cells), Points
crv = Curve(sqgrid.Cells)

# ---- group: Variate 变量
lng = ListLength(List=flatten(sqgrid.Cells))
random = Random(Range=Domain(0, 1), Number=lng, Seed=2)

# ---- group: Unit 单元
crv_2 = Curve(crv)

# ----
# Deconstruct Brep
# F端输出平面；E端输出四边；V端输出四个顶点
# 连接四边上的点和中心点
# 绘制中央十字线形。
# 绘制正方形四边上的可运动的一点
# C端输入线并右键重新定义曲线区间（Reparameterize）
# t端输入曲线上的一点的t值。
number_slider_2 = Slider(0.25, range=0..1)
debrep = DeconstructBrep(Brep=crv_2)  # -> Faces, Edges, Vertices
area = Area(Geometry=debrep.Faces)  # -> Area, Centroid
eval = EvaluateCurve(Curve=reparameterize(debrep.Edges), Parameter=number_slider_2)  # -> Point, Tangent, Angle
ln = Line(StartPoint=area.Centroid, EndPoint=eval.Point)

# ---- group: 下一步
graft = GraftTree(Tree=flatten(random), IncludeEmptyLists=True, IncludeNullItems=True)

# ----
eval_2 = EvaluateCurve(Curve=reparameterize(ln), Parameter=Slider(0.62, range=0..1))  # -> Point, Tangent, Angle
end = EndPoints(Curve=debrep.Edges)  # -> Start, End
graft_2 = GraftTree(Tree=eval_2.Point, IncludeEmptyLists=True, IncludeNullItems=True)
graft_3 = GraftTree(Tree=end.Start, IncludeEmptyLists=True, IncludeNullItems=True)
graft_4 = GraftTree(Tree=end.End, IncludeEmptyLists=True, IncludeNullItems=True)

# ----
# Polyline P端设置true 绘制三角形之后封面
pline = PolyLine(Vertices=[graft_2, graft_3, graft_4], Closed=True)
boundary = BoundarySurfaces(Edges=pline)
