# Grasshopper definition 1_PartA_Level2_02.gh (Grasshopper 1.0.7)

# ---- group: Frame 网架
# 生成思维 PartA Level2
number_slider = Slider(35, range=0..100)
sqgrid = Square(Plane=PlaneXY(0, 0, 0), Size=1, ExtentX=number_slider, ExtentY=Slider(20, range=0..100))  # -> flatten(Cells), Points
crv = Curve(sqgrid.Cells)

# ---- group: Variate 变量
lng = ListLength(List=flatten(sqgrid.Cells))
random = Random(Range=Domain(0, 1), Number=lng, Seed=2)

# ---- group: Unit 单元
crv_2 = Curve(crv)

# ----
# 怎么就产生随机变化了？我们重新梳理一下。一共700个正方形，每个正方形里有4个变形的三角形，它们通过定点向中心移动使得正方形内出现了风车状的图形。但每个移动的程度不一样，导致了每个风车都不一样，仅此而已。数据流呢？一共700个组（即正方形），每组匹配一个随机值（共700个），每组有四个数据（即四个三角）。说起来很清晰，但是真要彻底理解，就要学习Part B Level2了。这里建议大家把本节和Part B Level2结合起来反复默写。树形数据是GH的运算核心，也是新人唯一的门槛，这里看清了，接下来就简单了。
# 
# 为所有在线上运动的点，提供一个各不相同的随机t值。简单地说，这样做可以让所有的线上点运动到随机的位置。Graft输出的数据分别连接到两个t值的输入端。这里需注意曲线的数据分组结构和随机数值的数据分组结构是保持一致的而且——对应。如果因为前后的操作失误没有做到这一点，则会生成失败。建议对本书树形数据部分加深理解。
graft = GraftTree(Tree=flatten(random), IncludeEmptyLists=True, IncludeNullItems=True)

debrep = DeconstructBrep(Brep=crv_2)  # -> Faces, Edges, Vertices
area = Area(Geometry=debrep.Faces)  # -> Area, Centroid
eval = EvaluateCurve(Curve=reparameterize(debrep.Edges), Parameter=graft)  # -> Point, Tangent, Angle
ln = Line(StartPoint=area.Centroid, EndPoint=eval.Point)

eval_2 = EvaluateCurve(Curve=reparameterize(ln), Parameter=graft)  # -> Point, Tangent, Angle
end = EndPoints(Curve=debrep.Edges)  # -> Start, End
graft_2 = GraftTree(Tree=eval_2.Point, IncludeEmptyLists=True, IncludeNullItems=True)
graft_3 = GraftTree(Tree=end.Start, IncludeEmptyLists=True, IncludeNullItems=True)
graft_4 = GraftTree(Tree=end.End, IncludeEmptyLists=True, IncludeNullItems=True)

pline = PolyLine(Vertices=[graft_2, graft_3, graft_4], Closed=True)
boundary = BoundarySurfaces(Edges=pline)
