# Grasshopper definition 1_PartA_Level2_03.gh (Grasshopper 1.0.7)

# ---- group: Frame 网架
# 生成思维 PartA Level2：渐变
sqgrid = Square(Plane=PlaneXY(0, 0, 0), Size=1, ExtentX=35, ExtentY=20)  # -> flatten(Cells), Points
crv = Curve(sqgrid.Cells)

# ---- group: Varite 变量
line = Line(Line((3.436375241, 1.029539894, 0), (30.72675722, 17.18796708, 0)))
area = Area(Geometry=crv)  # -> Area, Centroid
crv_cp = CurveClosestPoint(Point=area.Centroid, Curve=reparameterize(line))  # -> Point, Parameter, Distance
graft = GraftTree(Tree=flatten(crv_cp.Parameter), IncludeEmptyLists=True, IncludeNullItems=True)

# ----
crv_2 = Curve(crv)

debrep = DeconstructBrep(Brep=crv_2)  # -> Faces, Edges, Vertices
eval = EvaluateCurve(Curve=reparameterize(debrep.Edges), Parameter=graft)  # -> Point, Tangent, Angle
area_2 = Area(Geometry=debrep.Faces)  # -> Area, Centroid
ln = Line(StartPoint=area_2.Centroid, EndPoint=eval.Point)

eval_2 = EvaluateCurve(Curve=reparameterize(ln), Parameter=graft)  # -> Point, Tangent, Angle
end = EndPoints(Curve=debrep.Edges)  # -> Start, End
graft_2 = GraftTree(Tree=eval_2.Point, IncludeEmptyLists=True, IncludeNullItems=True)
graft_3 = GraftTree(Tree=end.Start, IncludeEmptyLists=True, IncludeNullItems=True)
graft_4 = GraftTree(Tree=end.End, IncludeEmptyLists=True, IncludeNullItems=True)

pline = PolyLine(Vertices=[graft_2, graft_3, graft_4], Closed=True)
boundary = BoundarySurfaces(Edges=pline)
