# Grasshopper definition 2_PartB_Level1_00_1_longestlist.gh (Grasshopper 1.0.7)

# ----
# 线性数据运算法则
line = Line(Line((-8.184598691, 8.094376056, 0), (-9.572934385, -3.549729767, 0)))
# （1）画两条相对平行的直线（起始方向一致）
# （2）Divide Curve：在直线上绘制等分点。
# （3）显示点的列表序号，Size设置文字大小。
# （4）两点连成线观察连线结果。
number_slider = Slider(4, range=0..10)
line_2 = Line(Line((-2.272975734, 7.377815698, 0), (-3.750881474, -4.087150035, 0)))

divide_curve = DivideCurve(Curve=line, Count=Slider(5, range=0..10), Kinks=False)  # -> Points, Tangents, Parameters
divide_curve_2 = DivideCurve(Curve=line_2, Count=number_slider, Kinks=False)  # -> Points, Tangents, Parameters

point_list = PointList(Points=divide_curve.Points, Size="0.5")
point_list_2 = PointList(Points=divide_curve_2.Points, Size="0.5")

panel = Panel(divide_curve_2.Points)
panel_2 = Panel(divide_curve.Points)
line_3 = Line(StartPoint=divide_curve.Points, EndPoint=divide_curve_2.Points)
