# Grasshopper definition 2_PartB_Level1_00_2_shortestlist.gh (Grasshopper 1.0.7)

# ----
# 线性数据运算法则：shortestlist
line = Line(Line((-8.184598691, 8.094376056, 0), (-9.572934385, -3.549729767, 0)))
line_2 = Line(Line((-2.272975734, 7.377815698, 0), (-3.750881474, -4.087150035, 0)))

divide_curve = DivideCurve(Curve=line, Count=Slider(5, range=0..10), Kinks=False)  # -> Points, Tangents, Parameters
divide_curve_2 = DivideCurve(Curve=line_2, Count=Slider(4, range=0..10), Kinks=False)  # -> Points, Tangents, Parameters

point_list = PointList(Points=divide_curve.Points, Size="0.5")
point_list_2 = PointList(Points=divide_curve_2.Points, Size="0.5")

panel = Panel(divide_curve.Points)
panel_2 = Panel(divide_curve_2.Points)
shortest_list = ShortestList(ListA=divide_curve.Points, ListB=divide_curve_2.Points, TrimMode=2)  # -> ListA, ListB
line_3 = Line(StartPoint=shortest_list.ListA, EndPoint=shortest_list.ListB)
