# Grasshopper definition 2_PartB_Level1_00_4.gh (Grasshopper 1.0.7)

# ----
# set one line
number_slider = Slider(4, range=0..10)
line = Line(Line((-15.12579859, 6.562569496, 0), (-15.9917637, -3.540356775, 0)))
divide_curve = DivideCurve(Curve=line, Count=number_slider, Kinks=False)  # -> Points, Tangents, Parameters
circle = Circle(Plane=divide_curve.Points, Radius=Slider(0.8, range=0..1))
panel = Panel(circle)
panel_2 = Panel(divide_curve.Points)

line_2 = Line(Line((-7.434491032, 7.765833862, 0), (-4.822628526, -2.93554724, 0)))
divide_curve_2 = DivideCurve(Curve=line_2, Count=Slider(4, range=0..10), Kinks=False)  # -> Points, Tangents, Parameters
circle_2 = Circle(Plane=divide_curve_2.Points, Radius=[Slider(0.7, range=0..1), Slider(5, range=0..10)])
panel_3 = Panel(circle_2)
panel_4 = Panel(divide_curve_2.Points)
