# Grasshopper definition 2_PartB_Level1_01_数据阅读.gh (Grasshopper 1.0.7)

# ----
# 数据阅读：了解线性数据运算的基本规则
# Curve
# 提取700个正方形
# 有利于标记重要数据
panel = Panel("35")
square = Square(Plane=PlaneXY(0, 0, 0), Size=1, ExtentX=panel, ExtentY="20")  # -> flatten(Cells), Points
curve = Curve(square.Cells)

# ---- group: Variate 变量
list_length = ListLength(List=flatten(square.Cells))
random = Random(Range=Domain(0, 1), Number=list_length, Seed=2)

# ----
panel_2 = Panel(curve)
param_viewer = ParamViewer(curve)
panel_3 = Panel("参考系plane；边长size；X方向数量X；Y方向数量Y；运算得出700个正方形矩形Cells")

# ---- group: Unit 单元
curve_2 = Curve(curve)
area = Area(Geometry=curve_2)  # -> Area, Centroid
scale = Scale(Geometry=curve_2, Center=area.Centroid, Factor=random)  # -> Geometry, Transform

# ----
param_viewer_2 = ParamViewer(list_length)
运算得出一个数据长度 = Panel(list_length)

graft_tree = GraftTree(Tree=area.Area, IncludeEmptyLists=True, IncludeNullItems=True)
graft_tree_2 = GraftTree(Tree=area.Centroid, IncludeEmptyLists=True, IncludeNullItems=True)
area_center = Panel([graft_tree, graft_tree_2])

panel_4 = Panel("""700个正方形运算出：
700个正方形的面积Area
700个正方形的中心点Centroid""")
param_viewer_3 = ParamViewer(area.Centroid)

param_viewer_4 = ParamViewer(random)
panel_5 = Panel("""Range范围区间
Number数量N=700
Seed随机种子
得到700个随机的数值""")
panel_6 = Panel(random)

panel_7 = Panel(scale.Geometry)

panel_8 = Panel("""700个正方形Geometry
700个缩放的中心点Center
700个随机数值Factor
得到700个随机缩放后的正方形Geometry""")
param_viewer_5 = ParamViewer(scale.Geometry)
