# Grasshopper definition 2_PartB_Level1_01_数据阅读_单输入端运算法则.gh (Grasshopper 1.0.7)

# ----
# 两个数据列表。两条线。
number_slider = Slider(1, range=0..10)
number_slider_2 = Slider(4, range=0..10)
populate_2d = Populate2D(
    Region={Plane=PlaneXY(13.83369545, -0.03373960139, 0), Size=Domain2(u=-1.623684579..1.623684579, v=-0.3698392653..0.3698392653)},
    Count=number_slider_2,
    Seed=number_slider)
populate_2d_2 = Populate2D(Region={Plane=PlaneXY(0, 0, 0), Size=Domain2(u=0..20, v=0..10)}, Count=number_slider_2, Seed=Slider(7, range=0..10))
interpolate = Interpolate(Vertices=populate_2d, Degree=3, Periodic=False, KnotStyle=1)  # -> Curve, Length, Domain
point_list = PointList(Points=populate_2d, Size="0.5")
panel = Panel(populate_2d)
interpolate_2 = Interpolate(Vertices=populate_2d_2, Degree=3, Periodic=False, KnotStyle=1)  # -> Curve, Length, Domain
point_list_2 = PointList(Points=populate_2d_2, Size="0.5")
panel_2 = Panel(populate_2d_2)
