# Grasshopper definition 2_PartB_Level1_01_数据阅读_单输入端运算法则1.gh (Grasshopper 1.0.7)

# ----
# 两个数据列表。两条线。
number_slider = Slider(1, range=0..10)
number_slider_2 = Slider(4, range=0..10)
populate_2d = Populate2D(Region={Plane=PlaneXY(0, 0, 0), Size=Domain2(u=0..20, v=0..10)}, Count=number_slider_2, Seed=number_slider)
populate_2d_2 = Populate2D(Region={Plane=PlaneXY(0, 0, 0), Size=Domain2(u=0..20, v=0..10)}, Count=number_slider_2, Seed=Slider(2, range=0..10))
interpolate = Interpolate(Vertices=populate_2d, Degree=3, Periodic=False, KnotStyle=1)  # -> Curve, Length, Domain
point_list = PointList(Points=populate_2d, Size="0.5")
panel = Panel(populate_2d)
interpolate_2 = Interpolate(Vertices=populate_2d_2, Degree=3, Periodic=False, KnotStyle=1)  # -> Curve, Length, Domain
point_list_2 = PointList(Points=populate_2d_2, Size="0.5")
panel_2 = Panel(populate_2d_2)

# ----
# 合并成一个列表，一条线。
number_slider_3 = Slider(1, range=0..10)
number_slider_4 = Slider(4, range=0..10)
populate_2d_3 = Populate2D(Region={Plane=PlaneXY(0, 0, 0), Size=Domain2(u=0..20, v=0..10)}, Count=number_slider_4, Seed=number_slider_3)
populate_2d_4 = Populate2D(Region={Plane=PlaneXY(0, 0, 0), Size=Domain2(u=0..20, v=0..10)}, Count=number_slider_4, Seed=Slider(2, range=0..10))
interpolate_3 = Interpolate(Vertices=populate_2d_3, Degree=3, Periodic=False, KnotStyle=1)  # -> Curve, Length, Domain
point_list_3 = PointList(Points=populate_2d_3, Size="0.5")
panel_3 = Panel(populate_2d_3)
interpolate_4 = Interpolate(Vertices=populate_2d_4, Degree=3, Periodic=False, KnotStyle=1)  # -> Curve, Length, Domain
point_list_4 = PointList(Points=populate_2d_4, Size="0.5")
panel_4 = Panel(populate_2d_4)
