# Grasshopper definition 2_PartB_Level1_01_数据阅读_单输入端运算法则2.gh (Grasshopper 1.0.7)

# ----
# 合并成一个列表，一条线。
# 
# Entwine
number_slider = Slider(4, range=0..10)
populate_2d = Populate2D(Region={Plane=PlaneXY(0, 0, 0), Size=Domain2(u=0..20, v=0..10)}, Count=number_slider, Seed=2)
populate_2d_2 = Populate2D(Region={Plane=PlaneXY(0, 0, 0), Size=Domain2(u=0..20, v=0..10)}, Count=number_slider, Seed=1)
entwine = Entwine(Branch00=populate_2d, Branch01=populate_2d_2, FlattenInputs=True)  # -> flatten(Result)
interpolate = Interpolate(Vertices=flatten(entwine), Degree=3, Periodic=False, KnotStyle=1)  # -> Curve, Length, Domain
panel = Panel(entwine)
point_list = PointList(Points=entwine, Size="0.5")
