# Grasshopper definition 2_PartB_Level2_P76_树形图解.gh (Grasshopper 1.0.7)
# plug-ins: Bifocals

# ---- group: 树形图解
square = Square(Plane=PlaneXY(0, 0, 0), Size=1, ExtentX=Slider(5, range=1..10), ExtentY=Slider(4, range=1..10))  # -> Cells, Points
point = Point(square.Points)
param_viewer = ParamViewer(point)
param_viewer_2 = ParamViewer(point)
panel = Panel(point)

# ---- group: 排序
series = Series(Start=0, Step=1, Count=10)
series_2 = Series(Start=0, Step=1, Count=10)
graft_tree = GraftTree(Tree=series_2, IncludeEmptyLists=True, IncludeNullItems=True)
graft_tree_2 = GraftTree(Tree=series, IncludeEmptyLists=True, IncludeNullItems=True)
graft_tree_3 = GraftTree(Tree=graft_tree, IncludeEmptyLists=True, IncludeNullItems=True)
panel_2 = Panel(graft_tree_2)
panel_3 = Panel(graft_tree_3)
panel_4 = Panel([panel_2, panel_3])

# ---- group: 合并
series_3 = Series(Start=0, Step=1, Count=10)
series_4 = Series(Start=0, Step=1, Count=10)
graft_tree_4 = GraftTree(Tree=reverse(series_3), IncludeEmptyLists=True, IncludeNullItems=True)
graft_tree_5 = GraftTree(Tree=series_4, IncludeEmptyLists=True, IncludeNullItems=True)
panel_5 = Panel(graft_tree_4)
panel_6 = Panel(graft_tree_5)
panel_7 = Panel([panel_5, panel_6])
