# Grasshopper definition 2_PartB_Level2_P77_应用案例.gh (Grasshopper 1.0.7)
# plug-ins: Bifocals, ChopChop

square = Square(Plane=PlaneXY(0, 0, 0), Size=1, ExtentX=5, ExtentY=5)  # -> Cells, Points
point = Point(square.Points)
param_viewer = ParamViewer(point)
polyline = PolyLine(Vertices=point, Closed=False)
point_list = PointList(Points=point)

square_2 = Square(Plane=PlaneXY(0, 0, 0), Size=1, ExtentX=5, ExtentY=5)  # -> Cells, Points
point_2 = Point(flatten(square_2.Points))
polyline_2 = PolyLine(Vertices=point_2, Closed=False)
point_list_2 = PointList(Points=point_2)
param_viewer_2 = ParamViewer(point_2)

square_3 = Square(Plane=PlaneXY(0, 0, 0), Size=1, ExtentX=5, ExtentY=5)  # -> Cells, Points
point_3 = Point(square_3.Points)
flip_matrix = FlipMatrix(Data=point_3)
point_list_3 = PointList(Points=point_3)
param_viewer_3 = ParamViewer(flip_matrix)
polyline_3 = PolyLine(Vertices=flip_matrix, Closed=False)

chopchop = ChopChop()
