# Grasshopper definition 2_PartB_Level2_P78.gh (Grasshopper 1.0.7)
# plug-ins: Bifocals, ChopChop

分多少组 = Slider(10, range=0..10)
每组数据数量 = Slider(10, range=0..10)
surface = Surface(<surface referenced from the Rhino model>)
divide_surface = DivideSurface(Surface=surface, UCount=分多少组, VCount=每组数据数量)  # -> Points, Normals, Parameters
chopchop = ChopChop()
panel = Panel(divide_surface.Points)
flip_matrix = FlipMatrix(Data=divide_surface.Points)
管子半径 = Slider(0.8, range=0..1)
interpolate = Interpolate(Vertices=divide_surface.Points, Degree=3, Periodic=False, KnotStyle=1)  # -> Curve, Length, Domain
interpolate_2 = Interpolate(Vertices=flip_matrix, Degree=3, Periodic=False, KnotStyle=1)  # -> Curve, Length, Domain
pipe = Pipe(Curve=[interpolate.Curve, interpolate_2.Curve], Radius=管子半径, Caps=2)
panel_2 = Panel(pipe)
param_viewer = ParamViewer(pipe)
