# Grasshopper definition 2_PartB_Level2_P79.gh (Grasshopper 1.0.7)
# plug-ins: Bifocals, ChopChop

series = Series(Start=0, Step=1, Count=10)
chopchop = ChopChop()
panel = Panel(series)
graft_tree = GraftTree(Tree=series, IncludeEmptyLists=True, IncludeNullItems=True)

# ---- group: Graft生长法则
panel_2 = Panel(series)
panel_3 = Panel(graft_tree)

# ----
graft_tree_2 = GraftTree(Tree=panel, IncludeEmptyLists=True, IncludeNullItems=True)
graft_tree_3 = GraftTree(Tree=panel, IncludeEmptyLists=True, IncludeNullItems=True)
panel_4 = Panel(graft_tree_2)
panel_5 = Panel(graft_tree_3)
graft_tree_4 = GraftTree(Tree=[panel_4, panel_5], IncludeEmptyLists=True, IncludeNullItems=True)
panel_6 = Panel(graft_tree_4)
