# Grasshopper definition 3_PartC_Level1_00_贝塞尔曲线.gh (Grasshopper 1.0.7)

number_slider = Slider(0.2, range=0..1)
number_slider_2 = Slider(0.5, range=0..1)
number_slider_3 = Slider(0.8, range=0..1)

number_slider_4 = Slider(0.277, range=0..1)  # disabled

range = Range(Domain=Domain(0, 1), Steps=10)
graft_tree = GraftTree(Tree=range, IncludeEmptyLists=True, IncludeNullItems=True)

# ----
# 贝塞尔曲线原理
point = Point([Point(-10.47487028, 1.458526955, 0), Point(-6.429810163, 5.788565658, 0), Point(-7.21684932, -0.1768421742, 0), Point(-3.38326404, 3.218284753, 0), Point(-2.299418769, -1.509781739, 0), Point(1.365837643, 3.579636493, 0)])
shift_list = ShiftList(List=point, Shift=1, Wrap=False)
shortest_list = ShortestList(ListListA=point, ListListB=shift_list, TrimMode=2)  # -> ListListA, ListListB
line = Line(StartPoint=shortest_list.ListListA, EndPoint=shortest_list.ListListB)
evaluate_curve = EvaluateCurve(Curve=reparameterize(line), Parameter=[number_slider_4, graft_tree])  # -> Point, Tangent, Angle

range_2 = Range(Domain=Domain(0, 1), Steps=10)
graft_tree_2 = GraftTree(Tree=range_2, IncludeEmptyLists=True, IncludeNullItems=True)  # disabled

# ----
# 贝塞尔曲线原理
point_2 = Point([Point(5.647333214, 4.700710136, 0), Point(6.555959076, 9.360329941, 0), Point(8.955663275, 4.506559311, 0), Point(9.879821203, 9.07298672, 0), Point(11.63494466, 4.654113938, 0), Point(12.77655152, 9.337031842, 0)])
shift_list_2 = ShiftList(List=point_2, Shift=1, Wrap=False)
shortest_list_2 = ShortestList(ListListA=point_2, ListListB=shift_list_2, TrimMode=2)  # -> ListListA, ListListB
line_2 = Line(StartPoint=shortest_list_2.ListListA, EndPoint=shortest_list_2.ListListB)
evaluate_curve_2 = EvaluateCurve(Curve=reparameterize(line_2), Parameter=[number_slider, graft_tree_2, number_slider_2, number_slider_3])  # -> Point, Tangent, Angle

point_3 = Point(evaluate_curve.Point)
shift_list_3 = ShiftList(List=point_3, Shift=1, Wrap=False)
shortest_list_3 = ShortestList(ListListA=point_3, ListListB=shift_list_3, TrimMode=2)  # -> ListListA, ListListB
line_3 = Line(StartPoint=shortest_list_3.ListListA, EndPoint=shortest_list_3.ListListB)
evaluate_curve_3 = EvaluateCurve(Curve=reparameterize(line_3), Parameter=[graft_tree, number_slider_4])  # -> Point, Tangent, Angle

point_4 = Point(evaluate_curve_3.Point)
shift_list_4 = ShiftList(List=point_4, Shift=1, Wrap=False)
shortest_list_4 = ShortestList(ListListA=point_4, ListListB=shift_list_4, TrimMode=2)  # -> ListListA, ListListB
line_4 = Line(StartPoint=shortest_list_4.ListListA, EndPoint=shortest_list_4.ListListB)
evaluate_curve_4 = EvaluateCurve(Curve=reparameterize(line_4), Parameter=[graft_tree, number_slider_4])  # -> Point, Tangent, Angle

point_5 = Point(evaluate_curve_2.Point)
shift_list_5 = ShiftList(List=point_5, Shift=1, Wrap=False)
shortest_list_5 = ShortestList(ListListA=point_5, ListListB=shift_list_5, TrimMode=2)  # -> ListListA, ListListB
line_5 = Line(StartPoint=shortest_list_5.ListListA, EndPoint=shortest_list_5.ListListB)
evaluate_curve_5 = EvaluateCurve(Curve=reparameterize(line_5), Parameter=[graft_tree_2, number_slider, number_slider_2, number_slider_3])  # -> Point, Tangent, Angle

point_6 = Point(evaluate_curve_5.Point)
shift_list_6 = ShiftList(List=point_6, Shift=1, Wrap=False)
shortest_list_6 = ShortestList(ListListA=point_6, ListListB=shift_list_6, TrimMode=2)  # -> ListListA, ListListB
line_6 = Line(StartPoint=shortest_list_6.ListListA, EndPoint=shortest_list_6.ListListB)
evaluate_curve_6 = EvaluateCurve(Curve=reparameterize(line_6), Parameter=[graft_tree_2, number_slider, number_slider_2, number_slider_3])  # -> Point, Tangent, Angle

# ----
# 运算器设置使得贝塞尔曲线不闭合
# https://www.kancloud.cn/rhinostudio/ghuse100/1665784
interpolate = Interpolate(Vertices=flatten(evaluate_curve_4.Point), Degree=3, Periodic=False, KnotStyle=1)  # -> Curve, Length, Domain
curve = Curve(interpolate.Curve)

# ----
# 运算器设置使得贝塞尔曲线不闭合
# https://www.kancloud.cn/rhinostudio/ghuse100/1665784
interpolate_2 = Interpolate(Vertices=flatten(evaluate_curve_6.Point), Degree=3, Periodic=False, KnotStyle=1)  # -> Curve, Length, Domain
curve_2 = Curve(interpolate_2.Curve)

文字大小 = Panel("0.1")
point_list = PointList(Points=evaluate_curve_4.Point, Size=文字大小)

文字大小_2 = Panel("0.1")
point_list_2 = PointList(Points=evaluate_curve_6.Point, Size=文字大小_2)
