# Grasshopper definition 3_PartC_Level1_01_找形算法.gh (Grasshopper 1.0.7)

# 找形算法
crv = Curve(<curve referenced from the Rhino model>)
divide = DivideCurve(Curve=crv, Count="100", Kinks=False)  # -> Points, Tangents, Parameters
series = Series(Start=0, Step=1, Count="100")
panel = Panel(divide.Points)
graph = GraphMapper(series, x0=0, x1=100, y0=0, y1=1, container_name="Gaussian", factor=0.362488687, mean=0.4453750849, sdev=0.06304425001)
panel_2 = Panel(series)
shift = ShiftList(List=divide.Points, Shift=Slider(37, range=0..100), Wrap=True)
Z = UnitZ(Factor=graph)
panel_3 = Panel(shift)
panel_4 = Panel(graph)
move = Move(Geometry=shift, Motion=Z)  # -> Geometry, Transform
panel_5 = Panel(Z)
panel_6 = Panel(move.Geometry)
intcrv = Interpolate(Vertices=move.Geometry, Degree=3, Periodic=True, KnotStyle=1)  # -> Curve, Length, Domain
