# Grasshopper definition 3_PartC_Level1_02_参数反馈.gh (Grasshopper 1.0.7)

# 参数反馈
crv = Curve(<curve referenced from the Rhino model>)
divide = DivideCurve(Curve=crv, Count="100", Kinks=False)  # -> Points, Tangents, Parameters
series = Series(Start=0, Step=1, Count="100")
graph = GraphMapper(series, x0=0, x1=100, y0=0, y1=1, container_name="Gaussian", factor=0.5072463751, mean=0.5565216541, sdev=0.06304425001)
shift = ShiftList(List=divide.Points, Shift=Slider(30, range=0..100), Wrap=True)
Z = UnitZ(Factor=graph)
move = Move(Geometry=shift, Motion=Z)  # -> Geometry, Transform
intcrv = Interpolate(Vertices=move.Geometry, Degree=3, Periodic=True, KnotStyle=1)  # -> Curve, Length, Domain

pdecon = Deconstruct(Point=move.Geometry)  # -> XComponent, YComponent, ZComponent
bnd = Bounds(Numbers=pdecon.ZComponent)
dedomain = DeconstructDomain(Domain=bnd)  # -> Start, End
参数反馈显示 = Panel(dedomain.End)
