# Grasshopper definition @it读取shp文件.gh (Grasshopper 1.0.7)
# plug-ins: atit, Bifocals

path = FilePath("L:\同步\硬盘同步\犀流堂\网站课程\Grasshopper\【Finished】城市建筑快速生成\城市建筑数据\北京建筑轮廓数据\北京.shp")
toggle = BooleanToggle(True)
imp_it = ImpIt(ShapefileShpPath=path, Project2WGS84=False, TrueOrFalse=toggle)  # -> Shapes, Features
feat_it = FeatIt(ShapefileShpPath=path)  # -> GeometryType, ProjectionType, Features
item = ListItem(List=feat_it.Features, Index=0, Wrap=True)
datavis_it = DataVisIt(Shapes=imp_it.Shapes, GetValueofFeature=item, TrueOrFalse=toggle)  # -> Polygon, Polyline, Point, AttValues
scale = Scale(Geometry=datavis_it.Polygon, Center=Point(0, 0, 0), Factor=Slider(100000, range=0..100000))  # -> Geometry, Transform
