# Grasshopper definition city sim V1.0.gh (Grasshopper 1.0.7)
# plug-ins: ChopChop, Moonlight, Bifocals

# ---- group: 区域面积
rectangle = Rectangle({Plane=PlaneXY(2.246897192, 2.029678697, 0), Size=Domain2(u=-47.01339401..47.01339401, v=-29.84856841..29.84856841)})

# ---- group: 点生成
N = Slider(15, range=0..100)
layout = Slider(5, range=0..10)
populate_2d = Populate2D(Region=rectangle, Count=N, Seed=layout)

# ----
moonlight = Moonlight(Mode=Toggle(False))
boundary_surfaces = BoundarySurfaces(Edges=rectangle)
chopchop = ChopChop()

# ---- group: Buildings XYZ
seed = Slider(4, range=0..10)
seed_2 = Slider(5, range=0..10)
seed_3 = Slider(10, range=0..10)
random = Random(Range=Domain(5, 10), Number=N, Seed=seed)
random_2 = Random(Range=Domain(5, 8), Number=N, Seed=seed_2)
random_3 = Random(Range=Domain(5, 15), Number=N, Seed=seed_3)

# ----
point = Point(populate_2d)
rectangle_2 = Rectangle(Plane=point, XSize=random, YSize=random_2, Radius=0)  # -> Rectangle, Length
unit_z = UnitZ(Factor=random_3)

# ---- group: 生成 兴趣点 / POI生成区域
rectangle_3 = Rectangle({Plane=PlaneXY(5.873948607, -1.595210534, 0), Size=Domain2(u=-74.17255807..74.17255807, v=-48.7338002..48.7338002)})

# ---- group: 生成 兴趣点
N_2 = Slider(20, range=0..100)
layout_2 = Slider(5, range=0..10)
populate_2d_2 = Populate2D(Region=rectangle_3, Count=N_2, Seed=layout_2)
point_2 = Point(populate_2d_2)

# ----
boundary_surfaces_2 = BoundarySurfaces(Edges=rectangle_2.Rectangle)
boundary_surfaces_3 = BoundarySurfaces(Edges=rectangle_2.Rectangle)
rectangle_4 = Rectangle(rectangle_2.Rectangle)

# ---- group: Buildings
hypbuildings = Extrude(Base=rectangle_2.Rectangle, Direction=unit_z)

# ----
area = Area(Geometry=rectangle_4)  # -> graft(Area), Centroid
move = Move(Geometry=boundary_surfaces_2, Motion=unit_z)  # -> Geometry, Transform
graft_tree = GraftTree(Tree=area.Centroid, IncludeEmptyLists=True, IncludeNullItems=True)
面积计算 = Panel(area.Area)
point_3 = Point(area.Centroid)

# ---- group: Buildings
merge = Merge(Data1=boundary_surfaces_2, Data2=hypbuildings, Data3=move.Geometry)

# ----
closest_point = ClosestPoint(Point=point_3, Cloud=point_2)  # -> ClosestPoint, CPIndex, Distance
点坐标 = Panel(graft_tree)
line = Line(StartPoint=point_3, EndPoint=closest_point.ClosestPoint)

point_4 = Point(closest_point.ClosestPoint)
cloud_display = CloudDisplay(Points=point_4, Colours=RGB(255, 20, 147), Size="5", SpriteType=0)

pipe = Pipe(Curve=line, Radius=Slider(0.5, range=0.1..1.1), Caps=0)
dis_距离 = Panel(closest_point.Distance)
number = Number(line)
graft_tree_2 = GraftTree(Tree=number, IncludeEmptyLists=True, IncludeNullItems=True)  # -> flatten(Tree)
panel = Panel(pipe)
最短距离数据计算 = Panel(graft_tree_2)
