# Grasshopper definition city sim.gh (Grasshopper 1.0.7)
# plug-ins: ChopChop, Moonlight, Bifocals

moonlight = Moonlight(Mode=Toggle(False))
N = Slider(20, range=0..100)
layout = Slider(10, range=0..10)

# ---- group: 区域面积
rectangle = Rectangle({Plane=PlaneXY(2.246897192, 2.029678697, 0), Size=Domain2(u=-47.01339401..47.01339401, v=-29.84856841..29.84856841)})

# ----
N_2 = Slider(25, range=0..100)
layout_2 = Slider(10, range=0..10)
populate_2d = Populate2D(Region=rectangle, Count=N_2, Seed=layout_2)

# ---- group: 随机生成
N_3 = Slider(25, range=0..100)
layout_3 = Slider(5, range=0..10)
populate_2d_2 = Populate2D(Region=rectangle, Count=N_3, Seed=layout_3)

# ---- group: POI面积
rectangle_2 = Rectangle({Plane=PlaneXY(5.873948607, -1.595210534, 0), Size=Domain2(u=-74.17255807..74.17255807, v=-48.7338002..48.7338002)})

# ----
chopchop = ChopChop()
boundary_surfaces = BoundarySurfaces(Edges=rectangle)
populate_2d_3 = Populate2D(Region=rectangle_2, Count=N, Seed=layout)

# ---- group: rec Random
seed = Slider(5, range=0..10)
random = Random(Range=Domain(1, 10), Number=N_2, Seed=seed)

# ---- group: 随机生成
point = Point(populate_2d_2)

# ----
point_2 = Point(populate_2d)
point_3 = Point(populate_2d_3)
点坐标 = Panel(point)
seed_2 = Slider(5, range=0..10)
rectangle_2pt = Rectangle2Pt(Plane=boundary_surfaces, PointA=point, PointB=point_2, Radius=0)  # -> Rectangle, Length
rectangle_3 = Rectangle(Plane=point_2, XSize=Domain(-1, 1), YSize=Domain(-2, 2), Radius=0)  # -> Rectangle, Length
unit_z = UnitZ(Factor=random)
random_2 = Random(Range=Domain(1, 10), Number=N_3, Seed=seed_2)
长方形 = Panel(rectangle_2pt.Rectangle)
boundary_surfaces_2 = BoundarySurfaces(Edges=rectangle_2pt.Rectangle)

# ---- group: Buildings
hypbuildings = Extrude(Base=rectangle_3.Rectangle, Direction=unit_z)

# ----
unit_z_2 = UnitZ(Factor=random_2)
panel = Panel(random_2)
extrude = Extrude(Base=boundary_surfaces_2, Direction=unit_z_2)
