# Grasshopper definition view 2D.gh (Grasshopper 1.0.7)
# plug-ins: ChopChop, Moonlight

行走速度 = Slider(0.357, range=0..1)
视点高度 = Slider(1.6, range=0..10)
路径 = Curve()
evaluate_curve = EvaluateCurve(Curve=reparameterize(路径), Parameter=行走速度)  # -> Point, Tangent, Angle
unit_z = UnitZ(Factor=视点高度)
move = Move(Geometry=evaluate_curve.Point, Motion=unit_z)  # -> Geometry, Transform
dot_display = DotDisplay(Point=move.Geometry, Colour=ColourSwatch(SwatchColor=RGB(0, 0, 0)), Size=Slider(14, range=0..100))

moonlight = Moonlight(Mode=Toggle(False))
chopchop = ChopChop()

取样精度 = Slider(228, range=0..1000)
人视点半径 = Slider(219, range=0..1000)
isovist = IsoVist(Plane=move.Geometry, Count=取样精度, Radius=人视点半径)  # -> Points, Distance, Index

xy_plane = XYPlane(Origin=move.Geometry)
geometry = Geometry()
mesh_plane = MeshPlane(Mesh=geometry, Plane=xy_plane)

polyline = PolyLine(Vertices=isovist.Points, Closed=False)
boundary_surfaces = BoundarySurfaces(Edges=polyline)
custom_preview = CustomPreview(Geometry=boundary_surfaces, Material=ColourSwatch(SwatchColor=RGB(255, 255, 0)))
