# Grasshopper definition argis数据处理.gh (Grasshopper 1.0.7)
# plug-ins: Bifocals, LunchBox, Weaverbird

file_path = FilePath("C:\Users\Administrator\Desktop\杭州.xlsx")
excel_reader = ExcelReader(ReadExcelData=Toggle(True), WorkbookPath=file_path, WorksheetName="杭州")  # -> Exceptions, ExcelData
cull_index = CullIndex(List=excel_reader.ExcelData, Indices=Slider(0, range=0..100), Wrap=True)
split_list = SplitList(List=cull_index, Index=Slider(500, range=0..1000))  # -> ListA, ListB
explode_tree = ExplodeTree(Data=split_list.ListA)  # -> Branch0, Branch1, Branch2, Branch3, Branch4
construct_point = ConstructPoint(XCoordinate=explode_tree.Branch3, YCoordinate=explode_tree.Branch4, ZCoordinate=0)
panel = Panel(explode_tree.Branch2)
create_set = CreateSet(List=panel)  # -> Set, Map
member_index = MemberIndex(Set=explode_tree.Branch2, Member=create_set.Set)  # -> Index, Count
list_item = ListItem(List=explode_tree.Branch1, Index=member_index.Index, Wrap=True)
list_item_2 = ListItem(List=construct_point, Index=member_index.Index, Wrap=True)
create_set_2 = CreateSet(List=list_item)  # -> simplify(Set), Map
polyline = PolyLine(Vertices=list_item_2, Closed=True)
multiplication = Multiplication(A=create_set_2.Set, B=Slider(4, range=0..10))
scale = Scale(Geometry=polyline, Center=Point(0, 0, 0), Factor=Slider(100000, range=0..100000))  # -> Geometry, Transform
boundary_surfaces = BoundarySurfaces(Edges=scale.Geometry)
settings_speed = SettingsSpeed()
mesh_brep = MeshBrep(Brep=boundary_surfaces, Settings=settings_speed)
weaverbird_s_mesh_thicken = WeaverbirdsMeshThicken(MeshCurves=mesh_brep, Distance=expr("-x", multiplication), OffsetType=0)
mesh_join = MeshJoin(Meshes=flatten(weaverbird_s_mesh_thicken))
radians = Radians(Degrees=Slider(40, range=0..100))
unweld_mesh = UnweldMesh(Mesh=mesh_join, Angle=radians)
