# Grasshopper definition draft1007.gh (Grasshopper 1.0.7)
# plug-ins: ElkGHComponents

file_path = FilePath("C:\Users\asus\Desktop\OSM_data\map.osm")
location = Location(FilePathText=file_path)  # -> OSMPointData, OSMFile, LongitudeDomain, LatitudeDomain
osm_data = OSMData(
    OSMPointData=location.OSMPointData,
    OSMFilePath=location.OSMFile,
    Feature="building",
    Generate3d=True,
    IndividualOutputs=False)  # -> Ways, Buildings, FeatureKeys
polyline = PolyLine(Vertices=osm_data.Ways, Closed=True)
brep = Brep(osm_data.Buildings)
srf = Surface(polyline)
