# Grasshopper definition quick road generate.gh (Grasshopper 1.0.7)
# plug-ins: Moonlight, ChopChop

data = Data()
data_2 = Data()
data_3 = Data()
moonlight = Moonlight(Mode=Toggle(False))
chopchop = ChopChop()
longest_list = LongestList(ListListA=data, PaddingMode=2)  # -> ListListA, ListListB
longest_list_2 = LongestList(ListListA=data_2, PaddingMode=2)  # -> ListListA, ListListB
longest_list_3 = LongestList(ListListA=data_3, PaddingMode=2)  # -> ListListA, ListListB
entwine = Entwine(
    Branch00=longest_list.ListListA,
    Branch01=longest_list_2.ListListA,
    Branch02=longest_list_3.ListListA,
    FlattenInputs=True)
division = Division(A=entwine, B=Slider(2, range=0..10))  # -> simplify(Result)
negative = Negative(Value=division)
offset_curve = OffsetCurve(Distance=division, Corners=1)
offset_curve_2 = OffsetCurve(Distance=negative, Corners=1)
flatten_tree = FlattenTree(Tree=offset_curve, Path="{0}")
flatten_tree_2 = FlattenTree(Tree=offset_curve, Path="{0}")  # -> graft(Tree)
flatten_tree_3 = FlattenTree(Tree=offset_curve_2, Path="{0}")  # -> graft(Tree)
merge = Merge(Data1=offset_curve, Data2=offset_curve_2)  # -> simplify(Result)
list_length = ListLength(List=flatten_tree)
series = Series(Start=0, Step=1, Count=list_length)
loft = Loft(Curves=merge, Options={Adjust=False, Closed=False, LoftEnds=0, LoftSimp=0, LoftType=0, Rebuild=10, Refit=0.01})  # -> flatten(Loft)
cull_index = CullIndex(List=series, Indices=graft(series), Wrap=True)
list_item = ListItem(List=loft, Index=cull_index, Wrap=True)  # -> simplify(Item)
list_item_2 = ListItem(List=loft, Index=cull_index, Wrap=True)  # -> simplify(Item)
trim_with_regions = TrimWithRegions(Curve=flatten_tree_2, Regions=list_item)  # -> Inside, Outside
trim_with_regions_2 = TrimWithRegions(Curve=flatten_tree_3, Regions=list_item_2)  # -> Inside, Outside
merge_2 = Merge(Data1=trim_with_regions.Outside, Data2=trim_with_regions_2.Outside)  # -> simplify(flatten(Result))
curve = Curve()
join_curves = JoinCurves(Curves=merge_2, Preserve=curve)
