# Grasshopper definition test.gh (Grasshopper 1.0.7)
# plug-ins: NJSEnvironment, Human

# ---- group: Front Crv
curve = Curve(<curve referenced from the Rhino model>)

# ---- group: Boundaries
crv = Curve(<curve referenced from the Rhino model>)

# ---- group: Green Srf
srf = Surface(<surface referenced from the Rhino model>)

# ----
green_area_access_width = Slider(15, range=0..15)
internal_driveway_width = Slider(15, range=0..15)
footpath_width = Slider(3, range=0..10)
front_building_width = Slider(20, range=0..25)
min_plot_size = Slider(10000, range=0..100000)
max_plot_size = Slider(20000, range=0..100000)
front_setback = Slider(5, range=0..20)
max_site_coverage = Slider(0.6, range=0..1)
max_plot_ratio = Slider(3, range=0..10)
min_storey_count = Slider(5, range=0..10)
max_storey_count = Slider(5, range=0..10)
frontage_recess = Slider(5, range=0..10)
# Shop House Units with Balcony Generator
min_balcony_count = Slider(2, range=2..5)
max_balcony_count = Slider(5, range=3..5)
balcony_random_seed = Slider(580, range=0..1000)
min_green_plaza_area = Slider(500, range=0..1000)
min_plaza_width = Slider(10, range=0..100)
lateral_building_width = Slider(25, range=0..25)
vehicular_access_width = Slider(25, range=0..25)
side_setback = Slider(12, range=0..20)
ground_floor_height = Slider(5, range=0..10)
typical_floor_height = Slider(5, range=0..10)
top_floor_height = Slider(5, range=0..10)
dom = ConstructDomain(DomainStart=min_storey_count, DomainEnd=max_storey_count)
shop_house_units_with_balcony_generator = ShopHouseUnitsWithBalconyGenerator(
    num=min_balcony_count,
    num_2=max_balcony_count,
    num_3=balcony_random_seed,
    num_4=min_green_plaza_area,
    num_5=min_plaza_width,
    num_6=green_area_access_width,
    num_7=internal_driveway_width,
    num_8=footpath_width,
    num_9=lateral_building_width,
    num_10=front_building_width,
    num_11=vehicular_access_width,
    num_12=min_plot_size,
    num_13=max_plot_size,
    num_14=front_setback,
    num_15=side_setback,
    num_16=max_site_coverage,
    num_17=max_plot_ratio,
    domain=dom,
    num_18=frontage_recess,
    num_19=ground_floor_height,
    num_20=typical_floor_height,
    num_21=top_floor_height,
    crv=curve,
    crv_2=crv,
    srf=srf)  # -> txt_2, brep_5, srf_7, brep_6, srf_39, brep_2, srf_35

# ----
# OUTPUT VISUALIZATION
area = Area(Geometry=shop_house_units_with_balcony_generator.srf_35)  # -> expr("x/100", Area), Centroid
panel = Panel(shop_house_units_with_balcony_generator.txt_2)
round = Round(Number=area.Area)  # -> expr("0.5*x", Nearest), Floor, Ceiling
number_slider = Slider(10, range=0..10)
number_slider_2 = Slider(3, range=0..10)
popgeo = PopulateGeometry(Geometry=shop_house_units_with_balcony_generator.srf_35, Count=round.Nearest, Seed=Slider(27, range=0..100))
popgeo_2 = PopulateGeometry(Geometry=shop_house_units_with_balcony_generator.srf_39, Count=Slider(10, range=0..10), Seed=1)
edges = BrepEdges(Brep=shop_house_units_with_balcony_generator.brep_5)  # -> Naked, Interior, NonManifold
number_slider_3 = Slider(6, range=0..10)
number_slider_4 = Slider(2, range=0..10)
swatch = ColourSwatch(SwatchColor=RGB(32, 64, 26))
swatch_2 = ColourSwatch(SwatchColor=RGB(225, 44, 26))
preview = CustomPreview(Geometry=shop_house_units_with_balcony_generator.brep_5, Material=ColourSwatch(SwatchColor=RGB(255, 255, 255)))
preview_2 = CustomPreview(Geometry=shop_house_units_with_balcony_generator.brep_2, Material=ColourSwatch(SwatchColor=RGB(27, 164, 68)))
preview_3 = CustomPreview(Geometry=shop_house_units_with_balcony_generator.srf_7, Material=ColourSwatch(SwatchColor=RGB(207, 200, 184)))
preview_4 = CustomPreview(Geometry=shop_house_units_with_balcony_generator.brep_6, Material=ColourSwatch(SwatchColor=RGB(56, 133, 71)))
preview_5 = CustomPreview(Geometry=edges.Interior, Material=ColourSwatch(SwatchColor=RGB(0, 0, 0)))

ntree = SimpleTree(
    LocationPts=<missing>,
    TrunkScale=1,
    BranchMinScale=0.2,
    BranchMaxScale=0.4,
    Angle=55,
    IterationNumber=5,
    NumberOfBranch=5,
    Scale=<missing>,
    SeedNumber=1,
    Template=0)
ngrasscover = GrassCover(LocationPts=<missing>, Height1=<missing>, Height2=<missing>, Bend1=10, Template=0)
previewlw = CustomPreviewLineweights(Geometry=ntree, Shader=<missing>, Thickness=<missing>, Absolute=False)
previewlw_2 = CustomPreviewLineweights(Geometry=ngrasscover, Shader=<missing>, Thickness=<missing>, Absolute=False)

# ==== cluster ShopHouseUnitsWithBalconyGenerator
num = ClusterInput()
num_2 = ClusterInput()
num_3 = ClusterInput()
num_4 = ClusterInput()
num_5 = ClusterInput()
num_6 = ClusterInput()
num_7 = ClusterInput()
num_8 = ClusterInput()
num_9 = ClusterInput()
num_10 = ClusterInput()
num_11 = ClusterInput()
num_12 = ClusterInput()
num_13 = ClusterInput()
num_14 = ClusterInput()
num_15 = ClusterInput()
num_16 = ClusterInput()
num_17 = ClusterInput()
domain = ClusterInput()
num_18 = ClusterInput()
num_19 = ClusterInput()
num_20 = ClusterInput()
num_21 = ClusterInput()
crv = ClusterInput()
crv_2 = ClusterInput()
srf = ClusterInput()
srf_2 = Surface(srf)
num_22 = Number(num)
num_23 = Number(num_2)
num_24 = Number(num_3)
num_25 = Number(num_4)
num_26 = Number(num_5)
num_27 = Number(num_6)
num_28 = Number(num_7)
num_29 = Number(num_8)
num_30 = Number(num_9)
num_31 = Number(num_10)
num_32 = Number(num_11)
num_33 = Number(num_12)
num_34 = Number(num_13)
num_35 = Number(num_14)
num_36 = Number(num_15)
num_37 = Number(num_16)
num_38 = Number(num_17)
domain_2 = Domain(domain)
num_39 = Number(num_18)
num_40 = Number(num_19)
num_41 = Number(num_20)
num_42 = Number(num_21)
crv_3 = Curve(crv)
crv_4 = Curve(crv_2)
crv_5 = Curve(srf_2)

# ----
# Filter Front Curves
cluster = Cluster_3(B=crv_4, C=crv_3)  # -> C_2, L

crv_6 = Curve(cluster.L)

# ----
# Filter Vehicular
# Access Curve /
# Side Curves /
# Green Srf Crvs
cluster_2 = Cluster(curvepoint=crv_6, C=crv_5)  # -> C_2, crv_3, crv_4

# ---- group: Parcels
srf_3 = Surface(crv_4)

# ----
area = Area(Geometry=srf_3)  # -> Area, Centroid

# ---- group: Offset & Extend / Front Edges
crv_7 = Curve(simplify(cluster.C_2))

# ---- group: Offset & Extend / Vehicular Access Edges
crv_8 = Curve(simplify(cluster_2.crv_3))

# ---- group: Offset & Extend / Green Srf Edges
crv_9 = Curve(cluster_2.C_2)

# ---- group: Offset & Extend / Side Edges
crv_10 = Curve(simplify(cluster_2.crv_4))

# ----
panel = Panel(area.Area)
python = GhPythonScript(parcel_area_list=area.Area, min_plot_size=num_33, max_plot_size=num_34)  # -> Size_limit_flag; inputs parcel_area_list: list, min_plot_size: Int32, max_plot_size: Int32
# ---------- python: Python ----------
for index in range(len(parcel_area_list)):
    
    area = parcel_area_list[index]
    
    if area <= min_plot_size: 
        print('Land parcel area {} is UNDER the size limit.'.format(index))
    
    elif area >= max_plot_size:
        print('Land parcel area {} is EXCEEDING the size limit.'.format(index))
# ---------- end python ----------

# ---- group: Offset & Extend
side_crvs_offset = OffsetCurve(Curve=crv_10, Distance=expr("-1*x", num_36), Plane=PlaneXY(0, 0, 0), Corners=Slider(1, range=0..4))
side_crvs_offset_2 = OffsetCurve(Curve=crv_9, Distance=expr("-1*x", num_36), Plane=PlaneXY(0, 0, 0), Corners=Slider(1, range=0..4))
front_crvs_offset = OffsetCurve(Curve=crv_7, Distance=expr("-1*x", num_35), Plane=PlaneXY(0, 0, 0), Corners=Slider(1, range=0..4))
vehicular_access_crvs_offset = OffsetCurve(Curve=crv_8, Distance=expr("-1*x", num_32), Plane=PlaneXY(0, 0, 0), Corners=Slider(1, range=0..4))
number_slider = Slider(2, range=0..10)
len = Length(Curve=front_crvs_offset)
len_2 = Length(Curve=vehicular_access_crvs_offset)
len_3 = Length(Curve=side_crvs_offset)
len_4 = Length(Curve=side_crvs_offset_2)
num_43 = Number(expr("0.25*x", len))
num_44 = Number(expr("0.25*x", len_2))
num_45 = Number(expr("0.25*x", len_3))
num_46 = Number(expr("0.25*x", len_4))
ext = ExtendCurve(Curve=front_crvs_offset, Type=number_slider, Start=num_43, End=num_43)
ext_2 = ExtendCurve(Curve=vehicular_access_crvs_offset, Type=number_slider, Start=num_44, End=num_44)
ext_3 = ExtendCurve(Curve=side_crvs_offset, Type=number_slider, Start=num_45, End=num_45)
ext_4 = ExtendCurve(Curve=side_crvs_offset_2, Type=number_slider, Start=num_46, End=num_46)
combine = CombineData(Input0=ext_3, Input1=ext_2)  # -> Result, Index

# ----
crv_11 = Curve(crv_3)
crv_12 = Curve(side_crvs_offset_2)
crv_13 = Curve(crv_3)
num_47 = Number(num_31)
num_48 = Number(num_30)
num_49 = Number(num_31)
num_50 = Number(num_30)
txt = Text(python)
txt_2 = ClusterOutput(txt)

# ---- group: Get New Boundary
python_2 = GhPythonScript(L1=flatten(ext), L2=flatten(ext_2), L3=flatten(combine.Result), L4=flatten(ext_4))  # -> out_list; inputs L1: list, L2: list, L3: list, L4: list
# ---------- python_2: Python ----------
import ghpythonlib.treehelpers as th

out_list = []
for i in range(len(L1)):
    out_list.append([L1[i], L2[i], L3[i], L4[i]])

out_list = th.list_to_tree(out_list, source=[0,0])
# ---------- end python_2 ----------
srf_4 = Surface(graft(srf_3))
get_new_boundary = GetNewBoundary(srf=srf_4, G=python_2)  # -> i, C, en
srf_5 = Surface(get_new_boundary.i)
crv_14 = Curve(get_new_boundary.C)

# ---- group: Get New Boundary / Cull Duplicate Edges
mindex = MemberIndex(Set=simplify(flatten(combine.Index)), Member=0)  # -> Index, Count
replace = ReplaceItems(List=flatten(combine.Index), Indices=mindex.Index, Wrap=False)  # -> graft(List)
null = NullItem(Item=replace)  # -> NullFlags, InvalidFlags, Description
invbool = InvertBoolean(Boolean=null.NullFlags)  # -> Inverted, Number
cull = CullPattern(List=replace, CullPattern=invbool.Inverted)
cull_i = CullIndex(List=get_new_boundary.en, Indices=cull, Wrap=True)

# ---- group: Get New Boundary (continued)
crv_15 = Curve(cull_i)

# ----
# Filter Front Curves
cluster_3 = Cluster_3(B=crv_14, C=crv_11)  # -> C_2, L

crv_16 = Curve(cluster_3.L)

# ----
# Filter Vehicular
# Access Curve /
# Side Curves /
# Green Srf Crvs
cluster_4 = Cluster(curvepoint=crv_16, C=crv_12)  # -> C_2, crv_3, crv_4

# ---- group: Ground Floor Frontage Recess
offset = OffsetCurve(Curve=crv_14, Distance=expr("-x", num_39), Plane=PlaneXY(0, 0, 0), Corners=1)  # -> simplify(Curve)

# ----
# Filter Slab Typology Buildings
multiplication = Multiplication(A=num_26, B=3)
addition = Addition(A=num_30, B=num_30, C=multiplication)
len_5 = Length(Curve=cluster_3.C_2)
len_6 = Length(Curve=cluster_4.C_2)
larger = LargerThan(FirstNumber=len_5, SecondNumber=addition)  # -> LargerThan, OrEqualTo
larger_2 = LargerThan(FirstNumber=len_6, SecondNumber=addition)  # -> LargerThan, OrEqualTo
or = GateOr(A=larger.OrEqualTo, B=larger_2.OrEqualTo)  # -> simplify(Result)
invbool_2 = InvertBoolean(Boolean=or)  # -> Inverted, Number
cull_2 = CullPattern(List=crv_14, CullPattern=invbool_2.Inverted)  # -> flatten(List)
cull_3 = CullPattern(List=offset, CullPattern=invbool_2.Inverted)  # -> flatten(List)
cull_4 = CullPattern(List=graft(area.Area), CullPattern=invbool_2.Inverted)  # -> flatten(List)
cull_5 = CullPattern(List=cluster_3.C_2, CullPattern=invbool_2.Inverted)  # -> flatten(List)
cull_6 = CullPattern(List=cluster_4.crv_3, CullPattern=invbool_2.Inverted)  # -> flatten(List)
cull_7 = CullPattern(List=cluster_4.crv_4, CullPattern=invbool_2.Inverted)  # -> flatten(List)
cull_8 = CullPattern(List=cluster_4.C_2, CullPattern=invbool_2.Inverted)  # -> flatten(List)

# ----
# Filter Rest
cull_9 = CullPattern(List=crv_14, CullPattern=or)
cull_10 = CullPattern(List=graft(area.Area), CullPattern=or)  # -> flatten(List)
cull_11 = CullPattern(List=srf_3, CullPattern=flatten(or))
cull_12 = CullPattern(List=side_crvs_offset_2, CullPattern=or)  # -> flatten(List)
crv_17 = Curve(flatten(cull_9))
crv_18 = Curve(graft(crv_17))
crv_19 = Curve(graft(cull_12))

# ---- group: Ground Floor Frontage Recess
offset_2 = OffsetCurve(Curve=crv_18, Distance=expr("-x", num_39), Plane=PlaneXY(0, 0, 0), Corners=1)  # -> simplify(Curve)

# ----
slab_typology_generator = SlabTypologyGenerator(
    num=cull_4,
    srf=cull_2,
    srf_2=cull_3,
    F=num_40,
    num_2=num_41,
    F_2=num_42,
    A=num_22,
    B_2=num_23,
    max_site_coverage=num_37,
    crv=cull_5,
    crv_2=cull_6,
    crv_3=cull_7,
    crv_4=cull_8,
    S=num_24,
    I=domain_2,
    max_plot_ratio=num_38,
    B=num_28)  # -> E, E_2, L, G, E_3

# ----
# Filter Front Curves
cluster_5 = Cluster_3(B=crv_18, C=crv_13)  # -> C_2, L

crv_20 = Curve(crv_19)
crv_21 = Curve(cluster_5.L)

# ----
# Filter Vehicular
# Access Curve /
# Side Curves /
# Green Srf Crvs
cluster_6 = Cluster(curvepoint=crv_21, C=crv_20)  # -> C_2, crv_3, crv_4

# ---- group: Offset & Extend / Vehicular Access Edges
crv_22 = Curve(simplify(cluster_6.crv_3))

# ---- group: Offset & Extend / Front Edges
crv_23 = Curve(simplify(cluster_5.C_2))

# ---- group: Offset & Extend / Side Edges
crv_24 = Curve(simplify(cluster_6.crv_4))

# ---- group: Offset & Extend / Green Srf Edges
crv_25 = Curve(cluster_6.C_2)

# ---- group: Offset & Extend
side_crvs_offset_3 = OffsetCurve(Curve=crv_24, Distance=expr("-1*x", num_48), Plane=PlaneXY(0, 0, 0), Corners=Slider(1, range=0..4))
side_crvs_offset_4 = OffsetCurve(Curve=crv_25, Distance=expr("-1*x", num_47), Plane=PlaneXY(0, 0, 0), Corners=Slider(1, range=0..4))
front_crvs_offset_2 = OffsetCurve(Curve=crv_23, Distance=expr("-1*x", num_47), Plane=PlaneXY(0, 0, 0), Corners=Slider(1, range=0..4))
vehicular_access_crvs_offset_2 = OffsetCurve(Curve=crv_22, Distance=expr("-1*x", num_48), Plane=PlaneXY(0, 0, 0), Corners=Slider(1, range=0..4))
number_slider_2 = Slider(2, range=0..10)
len_7 = Length(Curve=front_crvs_offset_2)
len_8 = Length(Curve=vehicular_access_crvs_offset_2)
len_9 = Length(Curve=side_crvs_offset_3)
len_10 = Length(Curve=side_crvs_offset_4)
num_51 = Number(expr("0.25*x", len_7))
num_52 = Number(expr("0.25*x", len_8))
num_53 = Number(expr("0.25*x", len_9))
num_54 = Number(expr("0.25*x", len_10))
ext_5 = ExtendCurve(Curve=front_crvs_offset_2, Type=number_slider_2, Start=num_51, End=num_51)
ext_6 = ExtendCurve(Curve=vehicular_access_crvs_offset_2, Type=number_slider_2, Start=num_52, End=num_52)
ext_7 = ExtendCurve(Curve=side_crvs_offset_3, Type=number_slider_2, Start=num_53, End=num_53)
ext_8 = ExtendCurve(Curve=side_crvs_offset_4, Type=number_slider_2, Start=num_54, End=num_54)
combine_2 = CombineData(Input0=ext_7, Input1=ext_6)  # -> Result, Index

# ---- group: Make Block Opening / Opening location
# Make Openings
crv_26 = Curve(crv_22)
curvepoint = PointOnCurve(crv_26, parameter=0.5)
pt = Point(simplify(curvepoint))

# ---- group: Make Green Srf Opening / Opening location
crv_27 = Curve(crv_25)
curvepoint_2 = PointOnCurve(crv_27, parameter=0.551)
pt_2 = Point(simplify(curvepoint_2))

# ----
srf_6 = Surface(srf_5)
srf_7 = ClusterOutput(srf_6)

# ---- group: Get New Boundary
python_3 = GhPythonScript(L1=flatten(ext_5), L2=flatten(ext_6), L3=flatten(combine_2.Result), L4=flatten(ext_8))  # -> out_list; inputs L1: list, L2: list, L3: list, L4: list; same code as python_2
srf_8 = Surface(graft(cull_11))
get_new_boundary_2 = GetNewBoundary(srf=srf_8, G=python_3)  # -> i, C, en
crv_28 = Curve(simplify(get_new_boundary_2.C))
srf_9 = Surface(get_new_boundary_2.i)

# ---- group: Get New Boundary / Cull Duplicate Edges
mindex_2 = MemberIndex(Set=simplify(flatten(combine_2.Index)), Member=0)  # -> Index, Count
replace_2 = ReplaceItems(List=flatten(combine_2.Index), Indices=mindex_2.Index, Wrap=False)  # -> graft(List)
null_2 = NullItem(Item=replace_2)  # -> NullFlags, InvalidFlags, Description
invbool_3 = InvertBoolean(Boolean=null_2.NullFlags)  # -> Inverted, Number
cull_13 = CullPattern(List=replace_2, CullPattern=invbool_3.Inverted)
cull_i_2 = CullIndex(List=get_new_boundary_2.en, Indices=cull_13, Wrap=True)

# ---- group: Get New Boundary (continued)
crv_29 = Curve(cull_i_2)

# ----
# New Boundaries
crv_30 = Curve(simplify(crv_18))
crv_31 = Curve(crv_28)
srf_10 = Surface(offset_2)
srf_11 = Surface(crv_30)
srfsplit = SurfaceSplit(Surface=srf_10, Curves=crv_31)
srfsplit_2 = SurfaceSplit(Surface=srf_11, Curves=crv_31)
item = ListItem(List=srfsplit, Index=0, Wrap=True)
item_2 = ListItem(List=srfsplit_2, Index=0, Wrap=True)

# ----
# Mass Splitters
crv_32 = Curve(crv_28)
num_55 = Number(num_28)
divlength = DivideLength(Curve=crv_32, Length=num_55)  # -> Points, Tangents, Parameters
pframe = PerpFrame(Curve=crv_32, Parameter=divlength.Parameters)
cir = Circle(Plane=pframe, Radius=Slider(0.1, range=0..1))
srf_12 = Surface(item_2)
bcx = BrepCurve(Brep=srf_12, Curve=cir)  # -> Curves, Points
lng = ListLength(List=bcx.Points)
equals = Equality(FirstNumber=lng, SecondNumber=1)  # -> Equality, Inequality
cull_14 = CullPattern(List=bcx.Points, CullPattern=equals.Equality)
cull_15 = CullPattern(List=flatten(divlength.Points), CullPattern=flatten(equals.Equality))
trim = TrimTree(Tree=cull_14, Depth=1)
tstat = TreeStatistics(Tree=trim)  # -> Paths, Length, Count
partition = PartitionList(List=cull_15, Size=tstat.Length)
vec2pt = Vector2Pt(PointA=partition, PointB=trim, Unitize=False)  # -> Vector, Length
line = LineSDL(Start=partition, Direction=vec2pt.Vector, Length=Slider(50, range=0..100))
number_slider_3 = Slider(0.01, range=0..0.01)
ext_9 = ExtendCurve(Curve=line, Type=0, Start=number_slider_3, End=number_slider_3)

# ---- group: Split
srfsplit_3 = SurfaceSplit(Surface=item, Curves=ext_9)

srfsplit_4 = SurfaceSplit(Surface=item_2, Curves=ext_9)

# ---- group: Make Block Opening
area_2 = Area(Geometry=srfsplit_3)  # -> Area, Centroid
cps = ClosestPoints(Point=pt, Cloud=area_2.Centroid, Count=Slider(1, range=1..3))  # -> ClosestPoint, CPIndex, Distance
cull_i_3 = CullIndex(List=srfsplit_3, Indices=cps.CPIndex, Wrap=True)
srf_13 = Surface(cull_i_3)

cull_i_4 = CullIndex(List=srfsplit_4, Indices=cps.CPIndex, Wrap=True)
srf_14 = Surface(cull_i_4)

# ---- group: Make Green Srf Opening
area_3 = Area(Geometry=srf_13)  # -> Area, Centroid
cps_2 = ClosestPoints(Point=pt_2, Cloud=area_3.Centroid, Count=Slider(1, range=1..3))  # -> ClosestPoint, CPIndex, Distance
cull_i_5 = CullIndex(List=srf_13, Indices=cps_2.CPIndex, Wrap=True)
srf_15 = Surface(cull_i_5)

cull_i_6 = CullIndex(List=srf_14, Indices=cps_2.CPIndex, Wrap=True)
srf_16 = Surface(cull_i_6)

# ----
area_4 = Area(Geometry=srf_15)  # -> Area, Centroid
# Filter wrt. Site Coverage
ma = MassAddition(Input=area_4.Area)  # -> Result, PartialResults

# ----
# Site
# Coverage
division = Division(A=ma.Result, B=graft(cull_10))

num_56 = Number(expr("100*x", flatten(division)))
smaller = SmallerThan(FirstNumber=division, SecondNumber=num_37)  # -> SmallerThan, OrEqualTo
panel_2 = Panel(num_56)
invbool_4 = InvertBoolean(Boolean=smaller.SmallerThan)  # -> Inverted, Number

# ---- group: Smaller than Max Site Coverage
cull_16 = CullPattern(List=graft(cull_11), CullPattern=smaller.SmallerThan)  # -> flatten(List)
cull_17 = CullPattern(List=crv_18, CullPattern=smaller.SmallerThan)  # -> flatten(List)
cull_18 = CullPattern(List=crv_28, CullPattern=smaller.SmallerThan)  # -> flatten(List)
cull_19 = CullPattern(List=crv_23, CullPattern=smaller.SmallerThan)  # -> flatten(List)
cull_20 = CullPattern(List=crv_22, CullPattern=smaller.SmallerThan)  # -> flatten(List)
cull_21 = CullPattern(List=crv_24, CullPattern=smaller.SmallerThan)  # -> flatten(List)
cull_22 = CullPattern(List=crv_25, CullPattern=smaller.SmallerThan)  # -> flatten(List)
cull_23 = CullPattern(List=pt, CullPattern=smaller.SmallerThan)  # -> flatten(List)
crv_33 = Curve(graft(cull_17))
crv_34 = Curve(graft(cull_18))
crv_35 = Curve(graft(cull_19))
crv_36 = Curve(graft(cull_20))
crv_37 = Curve(graft(cull_21))
crv_38 = Curve(graft(cull_22))

# ---- group: Larger than Max Site Coverage
cull_24 = CullPattern(List=srf_16, CullPattern=invbool_4.Inverted)
cull_25 = CullPattern(List=srf_15, CullPattern=invbool_4.Inverted)
cull_26 = CullPattern(List=crv_28, CullPattern=invbool_4.Inverted)  # -> flatten(List)
cull_27 = CullPattern(List=graft(cull_10), CullPattern=invbool_4.Inverted)  # -> flatten(List)
cull_28 = CullPattern(List=pt, CullPattern=invbool_4.Inverted)  # -> flatten(List)
clean = CleanTree(RemoveNulls=True, RemoveInvalid=True, RemoveEmpty=True, Tree=cull_25)
clean_2 = CleanTree(RemoveNulls=True, RemoveInvalid=True, RemoveEmpty=True, Tree=cull_24)

# ----
dup = DuplicateData(Data=graft(cull_16), Number=2, Order=True)  # -> flatten(Data)
dup_2 = DuplicateData(Data=graft(cull_23), Number=2, Order=True)  # -> flatten(Data)

# ----
# Internal driveway
internal_driveway_generator = InternalDrivewayGenerator(crv=crv_36, crv_2=crv_38, srf=crv_33, D=num_28)  # -> C, new_parcels, i_2, i
srf_17 = Surface(internal_driveway_generator.new_parcels)

# ----
# Green Plazas
offset_3 = OffsetCurve(Curve=graft(cull_26), Distance=expr("-x", num_29), Plane=PlaneXY(0, 0, 0), Corners=1)  # -> simplify(Curve)
cx = CurveSelf(Curve=offset_3)  # -> Points, Params
tstat_2 = TreeStatistics(Tree=cx.Points)  # -> Paths, graft(Length), Count
equals_2 = Equality(FirstNumber=tstat_2.Length, SecondNumber=0)  # -> Equality, Inequality
cull_29 = CullPattern(List=flatten(offset_3), CullPattern=flatten(equals_2.Equality))  # -> graft(List)
area_5 = Area(Geometry=cull_29)  # -> Area, Centroid
larger_3 = LargerThan(FirstNumber=area_5.Area, SecondNumber=num_25)  # -> LargerThan, OrEqualTo
cull_30 = CullPattern(List=flatten(cull_29), CullPattern=flatten(larger_3.OrEqualTo))  # -> graft(List)
srf_18 = Surface(cull_30)
Z = UnitZ(Factor=0.2)
extr = Extrude(Base=srf_18, Direction=Z)

srf_19 = Surface(internal_driveway_generator.i_2)
srf_20 = Surface(internal_driveway_generator.i)
crv_39 = Curve(srf_19)
crv_40 = Curve(srf_20)
crv_41 = Curve(internal_driveway_generator.C)
crv_42 = Curve(srf_17)
crv_43 = Curve(flatten(crv_42))

# ---- group: Ground Floor Frontage Recess
offset_4 = OffsetCurve(Curve=crv_42, Distance=expr("-x", num_39), Plane=PlaneXY(0, 0, 0), Corners=1)  # -> simplify(Curve)

# ----
# Filter Edges
cluster_7 = Cluster_2(B=crv_39, C=crv_36)  # -> C_3, C_2
cluster_8 = Cluster_2(B=crv_39, C=crv_38)  # -> C_3, C_2
cluster_9 = Cluster_2(B=crv_40, C=crv_36)  # -> C_3, C_2
cluster_10 = Cluster_2(B=crv_40, C=crv_41)  # -> C_3, C_2
crv_44 = Curve(cluster_8.C_2)
crv_45 = Curve(cluster_10.C_3)
crv_46 = Curve(cluster_10.C_2)
crv_47 = Curve(cluster_7.C_3)
crv_48 = Curve(cluster_7.C_2)
crv_49 = Curve(cluster_8.C_3)
crv_50 = Curve(cluster_9.C_3)
crv_51 = Curve(cluster_9.C_2)
merge = Merge(Data1=simplify(crv_44), Data2=simplify(crv_46))  # -> flatten(Result)
merge_2 = Merge(Data1=simplify(crv_47), Data2=simplify(crv_50))  # -> flatten(Result)
merge_3 = Merge(Data1=simplify(crv_49), Data2=simplify(crv_45))  # -> flatten(Result)
merge_4 = Merge(Data1=simplify(crv_48), Data2=simplify(crv_51))  # -> flatten(Result)
crv_52 = Curve(graft(merge))
crv_53 = Curve(graft(merge_2))
crv_54 = Curve(graft(merge_4))
crv_55 = Curve(graft(merge_3))

crv_56 = Curve(graft(crv_43))
srfsplit_5 = SurfaceSplit(Surface=graft(cull_16), Curves=graft(crv_41))
srf_21 = Surface(srfsplit_5)
rev = ReverseList(List=srf_21)  # -> flatten(List)
srf_22 = Surface(graft(rev))

# ----
# Filter Slab Typology Buildings
multiplication_2 = Multiplication(A=num_26, B=4)
addition_2 = Addition(A=num_30, B=num_30, C=multiplication_2)
len_11 = Length(Curve=crv_52)
len_12 = Length(Curve=crv_55)
larger_4 = LargerThan(FirstNumber=len_11, SecondNumber=addition_2)  # -> LargerThan, OrEqualTo
larger_5 = LargerThan(FirstNumber=len_12, SecondNumber=addition_2)  # -> LargerThan, OrEqualTo
or_2 = GateOr(A=larger_4.OrEqualTo, B=larger_5.OrEqualTo)  # -> simplify(Result)
invbool_5 = InvertBoolean(Boolean=or_2)  # -> Inverted, Number
cull_31 = CullPattern(List=crv_56, CullPattern=invbool_5.Inverted)  # -> flatten(List)
cull_32 = CullPattern(List=offset_4, CullPattern=invbool_5.Inverted)  # -> flatten(List)
cull_33 = CullPattern(List=srf_22, CullPattern=invbool_5.Inverted)  # -> flatten(List)
cull_34 = CullPattern(List=crv_52, CullPattern=invbool_5.Inverted)  # -> flatten(List)
cull_35 = CullPattern(List=crv_53, CullPattern=invbool_5.Inverted)  # -> flatten(List)
cull_36 = CullPattern(List=crv_54, CullPattern=invbool_5.Inverted)  # -> flatten(List)
cull_37 = CullPattern(List=crv_55, CullPattern=invbool_5.Inverted)  # -> flatten(List)

cull_38 = CullPattern(List=srf_22, CullPattern=or_2)  # -> flatten(List)
cull_39 = CullPattern(List=graft(dup), CullPattern=or_2)  # -> flatten(List)
cull_40 = CullPattern(List=crv_56, CullPattern=or_2)  # -> flatten(List)
cull_41 = CullPattern(List=offset_4, CullPattern=or_2)  # -> flatten(List)
cull_42 = CullPattern(List=graft(dup_2), CullPattern=or_2)  # -> flatten(List)
cull_43 = CullPattern(List=crv_52, CullPattern=or_2)  # -> flatten(List)
cull_44 = CullPattern(List=crv_53, CullPattern=or_2)  # -> flatten(List)
cull_45 = CullPattern(List=crv_54, CullPattern=or_2)  # -> flatten(List)
cull_46 = CullPattern(List=crv_55, CullPattern=or_2)  # -> flatten(List)
area_6 = Area(Geometry=cull_33)  # -> Area, Centroid
crv_57 = Curve(graft(cull_43))
crv_58 = Curve(graft(cull_44))
crv_59 = Curve(graft(cull_45))
crv_60 = Curve(graft(cull_46))
slab_typology_generator_2 = SlabTypologyGenerator(
    num=area_6.Area,
    srf=cull_31,
    srf_2=cull_32,
    F=num_40,
    num_2=num_41,
    F_2=num_42,
    A=num_22,
    B_2=num_23,
    max_site_coverage=num_37,
    crv=cull_34,
    crv_2=cull_35,
    crv_3=cull_36,
    crv_4=cull_37,
    S=num_24,
    I=domain_2,
    max_plot_ratio=num_38,
    B=num_28)  # -> E, E_2, L, G, E_3

# ---- group: Offset & Extend / Vehicular Access Edges
crv_61 = Curve(simplify(crv_58))

# ---- group: Offset & Extend / Front Edges
crv_62 = Curve(simplify(crv_57))

# ---- group: Offset & Extend / Side Edges
crv_63 = Curve(simplify(crv_59))

# ---- group: Offset & Extend / Green Srf Edges
crv_64 = Curve(crv_60)

# ---- group: Offset & Extend
side_crvs_offset_5 = OffsetCurve(Curve=crv_64, Distance=expr("-1*x", num_49), Plane=PlaneXY(0, 0, 0), Corners=Slider(1, range=0..4))
side_crvs_offset_6 = OffsetCurve(Curve=crv_63, Distance=expr("-1*x", num_50), Plane=PlaneXY(0, 0, 0), Corners=Slider(1, range=0..4))
front_crvs_offset_3 = OffsetCurve(Curve=crv_62, Distance=expr("-1*x", num_49), Plane=PlaneXY(0, 0, 0), Corners=Slider(1, range=0..4))
vehicular_access_crvs_offset_3 = OffsetCurve(Curve=crv_61, Distance=expr("-1*x", num_50), Plane=PlaneXY(0, 0, 0), Corners=Slider(1, range=0..4))
number_slider_4 = Slider(2, range=0..10)
len_13 = Length(Curve=front_crvs_offset_3)
len_14 = Length(Curve=vehicular_access_crvs_offset_3)
len_15 = Length(Curve=side_crvs_offset_6)
len_16 = Length(Curve=side_crvs_offset_5)
num_57 = Number(expr("0.25*x", len_13))
num_58 = Number(expr("0.25*x", len_14))
num_59 = Number(expr("0.25*x", len_15))
num_60 = Number(expr("0.25*x", len_16))
ext_10 = ExtendCurve(Curve=front_crvs_offset_3, Type=number_slider_4, Start=num_57, End=num_57)
ext_11 = ExtendCurve(Curve=vehicular_access_crvs_offset_3, Type=number_slider_4, Start=num_58, End=num_58)
ext_12 = ExtendCurve(Curve=side_crvs_offset_6, Type=number_slider_4, Start=num_59, End=num_59)
ext_13 = ExtendCurve(Curve=side_crvs_offset_5, Type=number_slider_4, Start=num_60, End=num_60)
combine_3 = CombineData(Input0=ext_12, Input1=ext_11)  # -> Result, Index

# ---- group: Get New Boundary
python_4 = GhPythonScript(L1=flatten(ext_10), L2=flatten(ext_11), L3=flatten(combine_3.Result), L4=flatten(ext_13))  # -> out_list; inputs L1: list, L2: list, L3: list, L4: list; same code as python_2
srf_23 = Surface(graft(cull_39))
get_new_boundary_3 = GetNewBoundary(srf=srf_23, G=python_4)  # -> i, C, en
crv_65 = Curve(simplify(get_new_boundary_3.C))
srf_24 = Surface(get_new_boundary_3.i)

# ----
# New Boundaries
crv_66 = Curve(simplify(cull_40))
crv_67 = Curve(crv_65)
srf_25 = Surface(graft(cull_41))
srf_26 = Surface(graft(crv_66))
srfsplit_6 = SurfaceSplit(Surface=srf_25, Curves=crv_67)
srfsplit_7 = SurfaceSplit(Surface=srf_26, Curves=crv_67)
item_3 = ListItem(List=srfsplit_6, Index=0, Wrap=True)
item_4 = ListItem(List=srfsplit_7, Index=0, Wrap=True)

# ----
# Mass Splitters
crv_68 = Curve(crv_65)
num_61 = Number(num_28)
divlength_2 = DivideLength(Curve=crv_68, Length=num_61)  # -> Points, Tangents, Parameters
pframe_2 = PerpFrame(Curve=crv_68, Parameter=divlength_2.Parameters)
cir_2 = Circle(Plane=pframe_2, Radius=Slider(0.1, range=0..1))
srf_27 = Surface(item_4)
bcx_2 = BrepCurve(Brep=srf_27, Curve=cir_2)  # -> Curves, Points
lng_2 = ListLength(List=bcx_2.Points)
equals_3 = Equality(FirstNumber=lng_2, SecondNumber=1)  # -> Equality, Inequality
cull_47 = CullPattern(List=bcx_2.Points, CullPattern=equals_3.Equality)
cull_48 = CullPattern(List=flatten(divlength_2.Points), CullPattern=flatten(equals_3.Equality))
trim_2 = TrimTree(Tree=cull_47, Depth=1)
tstat_3 = TreeStatistics(Tree=trim_2)  # -> Paths, Length, Count
partition_2 = PartitionList(List=cull_48, Size=tstat_3.Length)
vec2pt_2 = Vector2Pt(PointA=partition_2, PointB=trim_2, Unitize=False)  # -> Vector, Length
line_2 = LineSDL(Start=partition_2, Direction=vec2pt_2.Vector, Length=Slider(50, range=0..100))
number_slider_5 = Slider(0.01, range=0..0.01)
ext_14 = ExtendCurve(Curve=line_2, Type=0, Start=number_slider_5, End=number_slider_5)

# ---- group: Split
srfsplit_8 = SurfaceSplit(Surface=item_3, Curves=ext_14)

srfsplit_9 = SurfaceSplit(Surface=item_4, Curves=ext_14)

# ---- group: Make Block Opening / Opening location
# Make Openings
crv_69 = Curve(crv_36)
curvepoint_3 = PointOnCurve(crv_69, parameter=0.5)
pt_3 = Point(simplify(curvepoint_3))

# ---- group: Make Block Opening
area_7 = Area(Geometry=srfsplit_8)  # -> Area, Centroid
cps_3 = ClosestPoints(Point=pt_3, Cloud=area_7.Centroid, Count=Slider(2, range=1..3))  # -> ClosestPoint, CPIndex, Distance
cull_i_7 = CullIndex(List=srfsplit_8, Indices=cps_3.CPIndex, Wrap=True)
srf_28 = Surface(cull_i_7)

cull_i_8 = CullIndex(List=srfsplit_9, Indices=cps_3.CPIndex, Wrap=True)
srf_29 = Surface(cull_i_8)

# ---- group: Make Green Srf Opening / Opening location
crv_70 = Curve(crv_64)
curvepoint_4 = PointOnCurve(crv_70, parameter=0.551)
pt_4 = Point(simplify(curvepoint_4))

# ---- group: Make Green Srf Opening
area_8 = Area(Geometry=srf_28)  # -> Area, Centroid
crv_cp = CurveClosestPoint(Point=pt_4, Curve=crv_5)  # -> Point, Parameter, flatten(Distance)
bnd = Bounds(Numbers=crv_cp.Distance)
dedomain = DeconstructDomain(Domain=bnd)  # -> expr("x + 1", Start), expr("x - x*0.1", End)
smaller_2 = SmallerThan(FirstNumber=crv_cp.Distance, SecondNumber=dedomain.Start)  # -> SmallerThan, OrEqualTo
cull_49 = CullPattern(List=pt_4, CullPattern=graft(smaller_2.OrEqualTo))
cps_4 = ClosestPoints(Point=cull_49, Cloud=area_8.Centroid, Count=Slider(1, range=1..3))  # -> ClosestPoint, CPIndex, Distance
cull_i_9 = CullIndex(List=srf_28, Indices=cps_4.CPIndex, Wrap=True)
srf_30 = Surface(simplify(cull_i_9))

cull_i_10 = CullIndex(List=srf_29, Indices=cps_4.CPIndex, Wrap=True)
srf_31 = Surface(simplify(cull_i_10))

# ----
area_9 = Area(Geometry=cull_38)  # -> Area, Centroid

# ----
# Green Plazas
srf_32 = Surface(crv_67)
area_10 = Area(Geometry=srf_32)  # -> Area, Centroid
multiplication_3 = Multiplication(A=num_25, B=3)
larger_6 = LargerThan(FirstNumber=area_10.Area, SecondNumber=multiplication_3)  # -> LargerThan, OrEqualTo
cull_50 = CullPattern(List=crv_67, CullPattern=larger_6.OrEqualTo)  # -> flatten(List)
offset_5 = OffsetCurve(Curve=graft(cull_50), Distance=expr("-x", num_29), Plane=PlaneXY(0, 0, 0), Corners=1)  # -> simplify(Curve)
cx_2 = CurveSelf(Curve=offset_5)  # -> Points, Params
tstat_4 = TreeStatistics(Tree=cx_2.Points)  # -> Paths, graft(Length), Count
equals_4 = Equality(FirstNumber=tstat_4.Length, SecondNumber=0)  # -> Equality, Inequality
cull_51 = CullPattern(List=flatten(offset_5), CullPattern=flatten(equals_4.Equality))  # -> graft(List)
area_11 = Area(Geometry=cull_51)  # -> Area, Centroid
larger_7 = LargerThan(FirstNumber=area_11.Area, SecondNumber=num_25)  # -> LargerThan, OrEqualTo
cull_52 = CullPattern(List=flatten(cull_51), CullPattern=flatten(larger_7.OrEqualTo))  # -> graft(List)
Z_2 = UnitZ(Factor=0.2)
srf_33 = Surface(cull_52)
extr_2 = Extrude(Base=srf_33, Direction=Z_2)

brep = Brep(simplify([extr_2, extr, srf_2]))
srf_34 = Surface(simplify([srf_33, srf_18, srf_2]))
brep_2 = ClusterOutput(brep)
srf_35 = ClusterOutput(srf_34)

# ----
# Site Coverage Optim
area_12 = Area(Geometry=clean)  # -> Area, Centroid
ma_2 = MassAddition(Input=area_12.Area)  # -> Result, PartialResults

# ----
# Site
# Coverage
division_2 = Division(A=ma_2.Result, B=graft(cull_27))

# ---- group: Cull Location index
cps_5 = ClosestPoints(Point=graft(cull_28), Cloud=area_12.Centroid, Count=1)  # -> ClosestPoint, CPIndex, Distance

# ----
num_62 = Number(expr("100*x", flatten(division_2)))
panel_3 = Panel(num_62)
python_5 = GhPythonScript(
    Srf_list=clean,
    max_site_coverage=num_37,
    site_coverage=flatten(division_2),
    total_area=flatten(cull_27),
    covered_area=flatten(ma_2.Result),
    cull_loc=flatten(cps_5.CPIndex))  # -> new_Srf_list, site_coverage, indices; inputs Srf_list: tree, site_coverage: list, total_area: list, covered_area: list, cull_loc: list of Int32; same code as python
panel_4 = Panel(python_5.site_coverage)
cull_i_11 = CullIndex(List=clean_2, Indices=python_5.indices, Wrap=True)
srf_36 = Surface(python_5.new_Srf_list)

# ----
# Plot Ratio Optim
area_13 = Area(Geometry=srf_36)  # -> Area, Centroid
area_14 = Area(Geometry=cull_i_11)  # -> Area, Centroid
ma_3 = MassAddition(Input=area_13.Area)  # -> Result, PartialResults
ma_4 = MassAddition(Input=area_14.Area)  # -> Result, PartialResults
dedomain_2 = DeconstructDomain(Domain=domain_2)  # -> Start, End
python_6 = GhPythonScript(
    min_floor_count=dedomain_2.Start,
    max_floor_count=dedomain_2.End,
    max_plot_ratio=num_38,
    gf_area=flatten(ma_3.Result),
    tf_area=flatten(ma_4.Result),
    parcel_area=flatten(cull_27))  # -> graft(floor_count_list); inputs min_floor_count: Int32, max_floor_count: Int32, gf_area: list, tf_area: list, parcel_area: list; same code as python_2

# ----
# Floor Massing
subtraction = Subtraction(A=python_6, B=2)
subtraction_2 = Subtraction(A=subtraction, B=1)
num_63 = Number(num_41)
multiplication_4 = Multiplication(A=num_63, B=subtraction_2)
Z_3 = UnitZ(Factor=num_40)
move = Move(Geometry=cull_i_11, Motion=Z_3)  # -> Geometry, Transform
dom = ConstructDomain(DomainStart=0, DomainEnd=multiplication_4)
range = Range(Domain=dom, Steps=expr("max(x-1, 1)", subtraction))
dcon = DeleteConsecutive(Set=range, Wrap=False)  # -> Set, Count
addition_3 = Addition(A=multiplication_4, B=num_63)
Z_4 = UnitZ(Factor=dcon.Set)  # -> simplify(UnitVector)
Z_5 = UnitZ(Factor=addition_3)
move_2 = Move(Geometry=move.Geometry, Motion=Z_5)  # -> Geometry, Transform
Z_6 = UnitZ(Factor=num_42)
Z_7 = UnitZ(Factor=num_63)

match = MatchTree(Tree=move.Geometry, Guide=Z_4)
python_7 = GhPythonScript(G=match, T=Z_4)  # -> simplify(T_G); inputs G: tree, T: tree; same code as python_3

# ---- group: Ground Floor Mass
extr_3 = Extrude(Base=srf_36, Direction=Z_3)

# ---- group: Typical Floor Mass
extr_4 = Extrude(Base=python_7, Direction=Z_7)

# ---- group: Top Floor Mass
extr_5 = Extrude(Base=move_2.Geometry, Direction=Z_6)

# ----
# Random Balcony Generation
dom_2 = ConstructDomain(DomainStart=num_22, DomainEnd=num_23)
tstat_5 = TreeStatistics(Tree=extr_5)  # -> Paths, expr("x - 1", Length), Count
random = Random(Range=dom_2, Number=tstat_5.Count, Seed=num_24, Integers=True)
random_2 = Random(Range=tstat_5.Length, Number=random, Seed=num_24, Integers=True)
lng_3 = ListLength(List=random_2)
dom_3 = ConstructDomain(DomainStart=Slider(1, range=0..100), DomainEnd=Slider(2, range=0..10))
random_3 = Random(Range=dom_3, Number=lng_3, Seed=num_24, Integers=True)
addition_4 = Addition(A=random_2, B=random_3)
dom_4 = ConstructDomain(DomainStart=random_2, DomainEnd=addition_4)
subtraction_3 = Subtraction(A=addition_4, B=random_2)
range_2 = Range(Domain=dom_4, Steps=expr("max(x, 1)", subtraction_3))
dcon_2 = DeleteConsecutive(Set=range_2, Wrap=False)  # -> Set, Count
trim_3 = TrimTree(Tree=dcon_2.Set, Depth=2)
cull_i_12 = CullIndex(List=extr_5, Indices=trim_3, Wrap=True)
item_5 = ListItem(List=extr_5, Index=trim_3, Wrap=True)
debrep = DeconstructBrep(Brep=item_5)  # -> Faces, Edges, Vertices
item_6 = ListItem(List=debrep.Faces, Index=0, Wrap=True)
area_15 = Area(Geometry=item_6)  # -> Area, Centroid
scale = Scale(Geometry=item_6, Center=area_15.Centroid, Factor=0.5)  # -> Geometry, Transform
Z_8 = UnitZ(Factor=0.2)
extr_6 = Extrude(Base=scale.Geometry, Direction=Z_8)

# ----
# Site Coverage Optim
area_16 = Area(Geometry=srf_30)  # -> Area, Centroid
ma_5 = MassAddition(Input=area_16.Area)  # -> Result, PartialResults

# ----
# Site
# Coverage
division_3 = Division(A=ma_5.Result, B=graft(area_9.Area))

# ---- group: Cull Location index
cps_6 = ClosestPoints(Point=graft(cull_42), Cloud=area_16.Centroid, Count=1)  # -> ClosestPoint, CPIndex, Distance

# ----
num_64 = Number(expr("100*x", flatten(division_3)))
panel_5 = Panel(num_64)
python_8 = GhPythonScript(
    Srf_list=srf_30,
    max_site_coverage=num_37,
    site_coverage=flatten(division_3),
    total_area=flatten(area_9.Area),
    covered_area=flatten(ma_5.Result),
    cull_loc=flatten(cps_6.CPIndex))  # -> new_Srf_list, site_coverage, indices; inputs Srf_list: tree, site_coverage: list, total_area: list, covered_area: list, cull_loc: list of Int32
# ---------- python_8: Python ----------
try:
    import ghpythonlib.components as ghcomp
    import ghpythonlib.treehelpers as th
except ImportError as e:  
    raise ImportError("Failed to import ghpythonlib.\n{}".format(e))


new_Srf_list = []
new_Srf = None
Srf_list = [list(i) for i in Srf_list.Branches]
indices = []

for i in range(len(Srf_list)):
    
    n = 1
    while site_coverage[i] > max_site_coverage:
        
        cull_idx_list = [idx for idx in range(cull_loc[i], cull_loc[i] + n)]
        new_Srf = ghcomp.CullIndex(Srf_list[i], cull_idx_list, True)
        
        # compute new site coverage
        new_covered_area, _ = ghcomp.Area(new_Srf)
        new_covered_area = sum(new_covered_area)
        new_site_coverage = new_covered_area/total_area[i]
        site_coverage[i] = new_site_coverage
        
        n += 1

    if n != 1:
        new_Srf_list.append([new_Srf])
        indices.append(cull_idx_list)
    else:
        new_Srf_list.append(Srf_list[i])
        indices.append([])

new_Srf_list = th.list_to_tree(new_Srf_list, source=[0,0])
indices = th.list_to_tree(indices, source=[0,0])
# ---------- end python_8 ----------
panel_6 = Panel(python_8.site_coverage)
cull_i_13 = CullIndex(List=srf_31, Indices=python_8.indices, Wrap=True)
srf_37 = Surface(python_8.new_Srf_list)

# ----
# Plot Ratio Optim
area_17 = Area(Geometry=srf_37)  # -> Area, Centroid
area_18 = Area(Geometry=cull_i_13)  # -> Area, Centroid
ma_6 = MassAddition(Input=area_17.Area)  # -> Result, PartialResults
ma_7 = MassAddition(Input=area_18.Area)  # -> Result, PartialResults
dedomain_3 = DeconstructDomain(Domain=domain_2)  # -> Start, End
python_9 = GhPythonScript(
    min_floor_count=dedomain_3.Start,
    max_floor_count=dedomain_3.End,
    max_plot_ratio=num_38,
    gf_area=flatten(ma_6.Result),
    tf_area=flatten(ma_7.Result),
    parcel_area=flatten(area_9.Area))  # -> graft(floor_count_list); inputs min_floor_count: Int32, max_floor_count: Int32, gf_area: list, tf_area: list, parcel_area: list; same code as python_2

# ----
# Floor Massing
subtraction_4 = Subtraction(A=python_9, B=2)
subtraction_5 = Subtraction(A=subtraction_4, B=1)
num_65 = Number(num_41)
multiplication_5 = Multiplication(A=num_65, B=subtraction_5)
Z_9 = UnitZ(Factor=num_40)
move_3 = Move(Geometry=cull_i_13, Motion=Z_9)  # -> Geometry, Transform
dom_5 = ConstructDomain(DomainStart=0, DomainEnd=multiplication_5)
range_3 = Range(Domain=dom_5, Steps=expr("max(x-1, 1)", subtraction_4))
dcon_3 = DeleteConsecutive(Set=range_3, Wrap=False)  # -> Set, Count
addition_5 = Addition(A=multiplication_5, B=num_65)
Z_10 = UnitZ(Factor=dcon_3.Set)  # -> simplify(UnitVector)
Z_11 = UnitZ(Factor=addition_5)
move_4 = Move(Geometry=move_3.Geometry, Motion=Z_11)  # -> Geometry, Transform
Z_12 = UnitZ(Factor=num_42)
Z_13 = UnitZ(Factor=num_65)

match_2 = MatchTree(Tree=move_3.Geometry, Guide=Z_10)
python_10 = GhPythonScript(G=match_2, T=Z_10)  # -> simplify(T_G); inputs G: tree, T: tree; same code as python_3

# ---- group: Ground Floor Mass
extr_7 = Extrude(Base=srf_37, Direction=Z_9)

# ---- group: Typical Floor Mass
extr_8 = Extrude(Base=python_10, Direction=Z_13)

# ---- group: Top Floor Mass
extr_9 = Extrude(Base=move_4.Geometry, Direction=Z_12)

# ----
# Random Balcony Generation
dom_6 = ConstructDomain(DomainStart=num_22, DomainEnd=num_23)
tstat_6 = TreeStatistics(Tree=extr_9)  # -> Paths, expr("x - 1", Length), Count
random_4 = Random(Range=dom_6, Number=tstat_6.Count, Seed=num_24, Integers=True)
random_5 = Random(Range=tstat_6.Length, Number=random_4, Seed=num_24, Integers=True)
lng_4 = ListLength(List=random_5)
dom_7 = ConstructDomain(DomainStart=Slider(1, range=0..100), DomainEnd=Slider(2, range=0..10))
random_6 = Random(Range=dom_7, Number=lng_4, Seed=num_24, Integers=True)
addition_6 = Addition(A=random_5, B=random_6)
dom_8 = ConstructDomain(DomainStart=random_5, DomainEnd=addition_6)
subtraction_6 = Subtraction(A=addition_6, B=random_5)
range_4 = Range(Domain=dom_8, Steps=expr("max(x, 1)", subtraction_6))
dcon_4 = DeleteConsecutive(Set=range_4, Wrap=False)  # -> Set, Count
trim_4 = TrimTree(Tree=dcon_4.Set, Depth=2)
cull_i_14 = CullIndex(List=extr_9, Indices=trim_4, Wrap=True)
item_7 = ListItem(List=extr_9, Index=trim_4, Wrap=True)
debrep_2 = DeconstructBrep(Brep=item_7)  # -> Faces, Edges, Vertices
item_8 = ListItem(List=debrep_2.Faces, Index=0, Wrap=True)
area_19 = Area(Geometry=item_8)  # -> Area, Centroid
scale_2 = Scale(Geometry=item_8, Center=area_19.Centroid, Factor=0.5)  # -> Geometry, Transform
Z_14 = UnitZ(Factor=0.2)
extr_10 = Extrude(Base=scale_2.Geometry, Direction=Z_14)

brep_3 = Brep(simplify([cull_i_14, extr_8, extr_7, slab_typology_generator_2.E, slab_typology_generator_2.E_2, slab_typology_generator_2.L, cull_i_12, extr_4, extr_3, slab_typology_generator.E, slab_typology_generator.E_2, slab_typology_generator.L]))
srf_38 = Surface(simplify([scale_2.Geometry, scale.Geometry, slab_typology_generator_2.G, slab_typology_generator.G]))
brep_4 = Brep(simplify([extr_10, extr_6, slab_typology_generator_2.E_3, slab_typology_generator.E_3]))
brep_5 = ClusterOutput(brep_3)
brep_6 = ClusterOutput(brep_4)
srf_39 = ClusterOutput(srf_38)

# ==== cluster GetNewBoundary
G = ClusterInput()
srf = ClusterInput()
number_slider = Slider(20, range=0..20)
srf_2 = Surface(srf)
Z = UnitZ(Factor=expr("-X*0.5", number_slider))
Z_2 = UnitZ(Factor=number_slider)
move = Move(Geometry=G, Motion=Z)  # -> Geometry, Transform
move_2 = Move(Geometry=move.Geometry, Motion=expr("x*2", Z_2))  # -> Geometry, Transform
move_3 = Move(Geometry=srf_2, Motion=Z_2)  # -> Geometry, Transform
match = MatchTree(Tree=move_3.Geometry, Guide=srf_2)
rulesrf = RuledSurface(CurveA=move_2.Geometry, CurveB=move.Geometry)
match_2 = MatchTree(Tree=rulesrf, Guide=srf_2)
S = Surface([srf_2, match, match_2])
bvol = BoundaryVolume(Boundaries=S)
debrep = DeconstructBrep(Brep=bvol)  # -> Faces, Edges, Vertices
area = Area(Geometry=debrep.Faces)  # -> Area, Centroid
pdecon = Deconstruct(Point=area.Centroid)  # -> XComponent, YComponent, ZComponent
sort = SortList(Keys=pdecon.ZComponent, ValuesA=debrep.Faces)  # -> Keys, ValuesA
item = ListItem(List=sort.ValuesA, Index=0, Wrap=True)
edges = BrepEdges(Brep=item)  # -> Naked, Interior, NonManifold
join = JoinCurves(Curves=edges.Naked, Preserve=False)
en = ClusterOutput(edges.Naked)
i = ClusterOutput(item)
C = ClusterOutput(join)

# ==== cluster SlabTypologyGenerator
max_plot_ratio = ClusterInput()
B = ClusterInput()
num = ClusterInput()
srf = ClusterInput()
srf_2 = ClusterInput()
F = ClusterInput()
num_2 = ClusterInput()
F_2 = ClusterInput()
A = ClusterInput()
B_2 = ClusterInput()
max_site_coverage = ClusterInput()
crv = ClusterInput()
crv_2 = ClusterInput()
crv_3 = ClusterInput()
crv_4 = ClusterInput()
S = ClusterInput()
I = ClusterInput()
num_3 = Number(num)
srf_3 = Surface(graft(srf_2))
crv_5 = Curve(graft(crv))
crv_6 = Curve(graft(crv_2))
crv_7 = Curve(graft(crv_3))
crv_8 = Curve(graft(crv_4))
srf_4 = Surface(graft(srf))
len = Length(Curve=crv_5)
len_2 = Length(Curve=crv_6)
len_3 = Length(Curve=crv_7)
len_4 = Length(Curve=crv_8)
division = Division(A=len, B=B)
division_2 = Division(A=len_2, B=B)
division_3 = Division(A=len_3, B=B)
division_4 = Division(A=len_4, B=B)
round = Round(Number=division)  # -> Nearest, Floor, Ceiling
round_2 = Round(Number=division_2)  # -> Nearest, Floor, Ceiling
round_3 = Round(Number=division_3)  # -> Nearest, Floor, Ceiling
round_4 = Round(Number=division_4)  # -> Nearest, Floor, Ceiling

# ----
# Mass Splitters
divide = DivideCurve(Curve=crv_5, Count=round.Floor, Kinks=False)  # -> Points, Tangents, Parameters
divide_2 = DivideCurve(Curve=crv_6, Count=round_2.Floor, Kinks=False)  # -> Points, Tangents, Parameters
number_slider = Slider(0, range=0..100)
divide_3 = DivideCurve(Curve=crv_7, Count=round_3.Floor, Kinks=False)  # -> Points, Tangents, Parameters
divide_4 = DivideCurve(Curve=crv_8, Count=round_4.Floor, Kinks=False)  # -> Points, Tangents, Parameters
lastdex = LastIndex(List=divide.Points)
lastdex_2 = LastIndex(List=divide_2.Points)
lastdex_3 = LastIndex(List=divide_3.Points)
lastdex_4 = LastIndex(List=divide_4.Points)
ins = InsertItems(List=lastdex, Item=number_slider, Indices=0, Wrap=True)
ins_2 = InsertItems(List=lastdex_2, Item=number_slider, Indices=0, Wrap=True)
ins_3 = InsertItems(List=lastdex_3, Item=number_slider, Indices=0, Wrap=True)
ins_4 = InsertItems(List=lastdex_4, Item=number_slider, Indices=0, Wrap=True)
cull_i = CullIndex(List=divide.Points, Indices=ins, Wrap=True)
cull_i_2 = CullIndex(List=divide_2.Points, Indices=ins_2, Wrap=True)
cull_i_3 = CullIndex(List=divide_3.Points, Indices=ins_3, Wrap=True)
cull_i_4 = CullIndex(List=divide_4.Points, Indices=ins_4, Wrap=True)
rev = ReverseList(List=cull_i)
rev_2 = ReverseList(List=cull_i_2)
number_slider_2 = Slider(0.01, range=0..0.01)

short = ShortestList(ListA=rev, ListB=cull_i_4, TrimMode=2)  # -> ListA, ListB
short_2 = ShortestList(ListA=rev_2, ListB=cull_i_3, TrimMode=2)  # -> ListA, ListB

ln = Line(StartPoint=short.ListA, EndPoint=short.ListB)
ln_2 = Line(StartPoint=short_2.ListA, EndPoint=short_2.ListB)
merge = Merge(Data1=ln, Data2=ln_2)
ext = ExtendCurve(Curve=merge, Type=0, Start=number_slider_2, End=number_slider_2)

# ---- group: Split
srfsplit = SurfaceSplit(Surface=srf_3, Curves=ext)

srfsplit_2 = SurfaceSplit(Surface=srf_4, Curves=ext)

# ----
# Site Coverage Optim
area = Area(Geometry=srfsplit)  # -> Area, Centroid
ma = MassAddition(Input=area.Area)  # -> Result, PartialResults

# ---- group: Cull Location index
crv_9 = Curve(crv_6)
curvepoint = PointOnCurve(crv_9, parameter=0.5)
pt = Point(simplify(curvepoint))
cps = ClosestPoints(Point=pt, Cloud=area.Centroid, Count=1)  # -> ClosestPoint, CPIndex, Distance

# ----
# Site
# Coverage
division_5 = Division(A=ma.Result, B=graft(num_3))

num_4 = Number(expr("100*x", flatten(division_5)))
panel = Panel(num_4)
python = GhPythonScript(
    Srf_list=srfsplit,
    max_site_coverage=max_site_coverage,
    site_coverage=flatten(division_5),
    total_area=flatten(num_3),
    covered_area=flatten(ma.Result),
    cull_loc=flatten(cps.CPIndex))  # -> new_Srf_list, site_coverage, indices; inputs Srf_list: tree, site_coverage: list, total_area: list, covered_area: list, cull_loc: list of Int32
# ---------- python: Python ----------
try:
    import ghpythonlib.components as ghcomp
    import ghpythonlib.treehelpers as th
except ImportError as e:  
    raise ImportError("Failed to import ghpythonlib.\n{}".format(e))


new_Srf_list = []
new_Srf = None
Srf_list = [list(i) for i in Srf_list.Branches]
indices = []

for i in range(len(Srf_list)):
    
    n = 1
    while site_coverage[i] > max_site_coverage:
        
        cull_idx_list = [idx for idx in range(cull_loc[i], cull_loc[i] + n)]
        new_Srf = ghcomp.CullIndex(Srf_list[i], cull_idx_list, True)
        
        # compute new site coverage
        new_covered_area, _ = ghcomp.Area(new_Srf)
        new_covered_area = sum(new_covered_area)
        new_site_coverage = new_covered_area/total_area[i]
        site_coverage[i] = new_site_coverage
        
        n += 1
    
    if n != 1:
        new_Srf_list.append([new_Srf])
        indices.append(cull_idx_list)
    else:
        new_Srf_list.append(Srf_list[i])
        indices.append([])

new_Srf_list = th.list_to_tree(new_Srf_list, source=[0,0])
indices = th.list_to_tree(indices, source=[0,0])
# ---------- end python ----------
panel_2 = Panel(python.site_coverage)
cull_i_5 = CullIndex(List=srfsplit_2, Indices=python.indices, Wrap=True)
srf_5 = Surface(python.new_Srf_list)

# ----
# Plot Ratio Optim
area_2 = Area(Geometry=cull_i_5)  # -> Area, Centroid
area_3 = Area(Geometry=srf_5)  # -> Area, Centroid
ma_2 = MassAddition(Input=area_2.Area)  # -> Result, PartialResults
ma_3 = MassAddition(Input=area_3.Area)  # -> Result, PartialResults
dedomain = DeconstructDomain(Domain=I)  # -> Start, End
python_2 = GhPythonScript(
    min_floor_count=dedomain.Start,
    max_floor_count=dedomain.End,
    max_plot_ratio=max_plot_ratio,
    gf_area=flatten(ma_3.Result),
    tf_area=flatten(ma_2.Result),
    parcel_area=flatten(num_3))  # -> graft(floor_count_list); inputs min_floor_count: Int32, max_floor_count: Int32, gf_area: list, tf_area: list, parcel_area: list
# ---------- python_2: Python ----------
try:
    import ghpythonlib.treehelpers as th
except ImportError as e:  
    raise ImportError("Failed to import ghpythonlib.\n{}".format(e))


floor_count_list = []

for i in range(len(parcel_area)):
    
    for floor_count in range(min_floor_count, max_floor_count + 1):
        plot_ratio = (gf_area[i] + (floor_count - 1)*tf_area[i])/parcel_area[i]
        
        if plot_ratio > max_plot_ratio:
            floor_count = max(floor_count - 1, min_floor_count)
            floor_count_list.append(floor_count)
            break
        
        elif floor_count == max_floor_count and plot_ratio <= max_plot_ratio:
            floor_count_list.append(floor_count)

floor_count_list = th.list_to_tree(floor_count_list, source=[0,0])
# ---------- end python_2 ----------

# ----
# Floor Massing
subtraction = Subtraction(A=python_2, B=2)
subtraction_2 = Subtraction(A=subtraction, B=1)
num_5 = Number(num_2)
multiplication = Multiplication(A=num_5, B=subtraction_2)
Z = UnitZ(Factor=F)
dom = ConstructDomain(DomainStart=0, DomainEnd=multiplication)
move = Move(Geometry=cull_i_5, Motion=Z)  # -> Geometry, Transform
range = Range(Domain=dom, Steps=expr("max(x-1, 1)", subtraction))
dcon = DeleteConsecutive(Set=range, Wrap=False)  # -> Set, Count
addition = Addition(A=multiplication, B=num_5)
Z_2 = UnitZ(Factor=dcon.Set)
Z_3 = UnitZ(Factor=addition)
move_2 = Move(Geometry=move.Geometry, Motion=Z_3)  # -> Geometry, Transform
Z_4 = UnitZ(Factor=F_2)
Z_5 = UnitZ(Factor=num_5)

match = MatchTree(Tree=move.Geometry, Guide=Z_2)
python_3 = GhPythonScript(G=match, T=Z_2)  # -> simplify(T_G); inputs G: tree, T: tree
# ---------- python_3: Python ----------
try:
    import ghpythonlib.components as ghcomp
    import ghpythonlib.treehelpers as th
except ImportError as e:  
    raise ImportError("Failed to import ghpythonlib.\n{}".format(e))

G = [list(i) for i in G.Branches]
T = [list(i) for i in T.Branches]
T_G = []

for i in range(len(G)):
    t_G = []
    for t in T[i]:
        newG, _ = ghcomp.Move(G[i], t)
        t_G.append(newG)
    T_G.append(t_G)

T_G = th.list_to_tree(T_G, source=[0,0])
# ---------- end python_3 ----------

# ---- group: Ground Floor Mass
extr = Extrude(Base=srf_5, Direction=Z)

# ---- group: Typical Floor Mass
extr_2 = Extrude(Base=python_3, Direction=Z_5)

# ---- group: Top Floor Mass
extr_3 = Extrude(Base=move_2.Geometry, Direction=Z_4)

# ----
E = ClusterOutput(extr)
E_2 = ClusterOutput(extr_2)

# ----
# Random Balcony Generation
tstat = TreeStatistics(Tree=extr_3)  # -> Paths, expr("x - 1", Length), Count
dom_2 = ConstructDomain(DomainStart=A, DomainEnd=B_2)
random = Random(Range=dom_2, Number=tstat.Count, Seed=S, Integers=True)
dom_3 = ConstructDomain(DomainStart=Slider(1, range=0..10), DomainEnd=Slider(3, range=0..10))
Z_6 = UnitZ(Factor=0.2)

lng = ListLength(List=tstat.Length)
random_2 = Random(Range=S, Number=lng, Seed=2, Integers=True)

random_3 = Random(Range=tstat.Length, Number=random, Seed=random_2, Integers=True)
lng_2 = ListLength(List=random_3)
random_4 = Random(Range=dom_3, Number=lng_2, Seed=S, Integers=True)
addition_2 = Addition(A=random_3, B=random_4)
dom_4 = ConstructDomain(DomainStart=random_3, DomainEnd=addition_2)
subtraction_3 = Subtraction(A=addition_2, B=random_3)
range_2 = Range(Domain=dom_4, Steps=expr("max(x, 1)", subtraction_3))
dcon_2 = DeleteConsecutive(Set=range_2, Wrap=False)  # -> Set, Count
trim = TrimTree(Tree=dcon_2.Set, Depth=2)
cull_i_6 = CullIndex(List=extr_3, Indices=trim, Wrap=True)
item = ListItem(List=extr_3, Index=trim, Wrap=True)
debrep = DeconstructBrep(Brep=item)  # -> Faces, Edges, Vertices
item_2 = ListItem(List=debrep.Faces, Index=0, Wrap=True)
area_4 = Area(Geometry=item_2)  # -> Area, Centroid
scale = Scale(Geometry=item_2, Center=area_4.Centroid, Factor=0.5)  # -> Geometry, Transform
extr_4 = Extrude(Base=scale.Geometry, Direction=Z_6)

L = ClusterOutput(cull_i_6)
G = ClusterOutput(scale.Geometry)
E_3 = ClusterOutput(extr_4)

# ==== cluster InternalDrivewayGenerator
D = ClusterInput()
crv = ClusterInput()
crv_2 = ClusterInput()
srf = ClusterInput()
crv_3 = Curve(crv)
crv_4 = Curve(crv_2)
end = EndPoints(Curve=crv_4)  # -> Start, End
len = Length(Curve=crv_3)
ln = Line(StartPoint=end.Start, EndPoint=end.End)
number_slider = Slider(200, range=0..1000)
offset = OffsetCurve(Curve=ln, Distance=expr("-1/2*x", len), Plane=PlaneXY(0, 0, 0), Corners=1)
ext = ExtendCurve(Curve=offset, Type=0, Start=number_slider, End=number_slider)
offcrv = OffsetCurve(Curve=ext, Plane=PlaneXY(0, 0, 0), Distance=expr("x/2", D), BothSides=Toggle(True), Kinks=0, CapType=0)
srf_2 = Surface(srf)
split = SplitList(List=offcrv, Index=1)  # -> ListA, ListB
srfsplit = SurfaceSplit(Surface=srf_2, Curves=split.ListA)
split_2 = SplitList(List=srfsplit, Index=1)  # -> ListA, ListB
srfsplit_2 = SurfaceSplit(Surface=split_2.ListA, Curves=split.ListB)
srfsplit_3 = SurfaceSplit(Surface=split_2.ListB, Curves=split.ListB)
item = ListItem(List=srfsplit_3, Index=0, Wrap=True)  # -> simplify(Item)
item_2 = ListItem(List=srfsplit_2, Index=0, Wrap=True)  # -> simplify(Item)
merge = Merge(Data1=item, Data2=item_2)
C = ClusterOutput(ext)
new_parcels = ClusterOutput(merge)
i = ClusterOutput(item_2)
i_2 = ClusterOutput(item)

# ==== cluster Cluster
curvepoint = ClusterInput()
C = ClusterInput()
curvepoint_2 = PointOnCurve(curvepoint, parameter=0.5)
max_distance_from_green_srf = Slider(2, range=0..10)
crv_cp = CurveClosestPoint(Point=curvepoint_2, Curve=C)  # -> Point, Parameter, Distance
python = GhPythonScript(distance_list=crv_cp.Distance, max_distance=max_distance_from_green_srf)  # -> out, bool_mask; inputs distance_list: list
# ---------- python: Python ----------
__author__ = "houssame"
__version__ = "2021.11.13"

bool_mask_ = []

for d in distance_list:
    
    if d <= max_distance:
        mask = True
        bool_mask_.append(mask)
    
    else:
        mask = False
        bool_mask_.append(mask)
# ---------- end python ----------
invbool = InvertBoolean(Boolean=python.bool_mask)  # -> Inverted, Number

# ---- group: Side Crvs
cull = CullPattern(List=curvepoint, CullPattern=invbool.Inverted)
join = JoinCurves(Curves=cull, Preserve=False)
split = SplitList(List=join, Index=1)  # -> ListA, ListB

# ---- group: Green Area Crvs
cull_2 = CullPattern(List=curvepoint, CullPattern=python.bool_mask)
join_2 = JoinCurves(Curves=cull_2, Preserve=False)

# ---- group: Side Crvs / Vehicular Access Crvs
crv = Curve(split.ListA)

# ---- group: Side Crvs
crv_2 = Curve(split.ListB)

# ----
crv_3 = ClusterOutput(crv)
crv_4 = ClusterOutput(crv_2)
C_2 = ClusterOutput(join_2)

# ==== cluster Cluster_2
C = ClusterInput()
B = ClusterInput()
debrep = DeconstructBrep(Brep=B)  # -> Faces, Edges, Vertices
curvepoint = PointOnCurve(debrep.Edges, parameter=0.5)
crv_cp = CurveClosestPoint(Point=curvepoint, Curve=C)  # -> Point, Parameter, Distance
bnd = Bounds(Numbers=crv_cp.Distance)
dedomain = DeconstructDomain(Domain=bnd)  # -> expr("x + 1", Start), expr("x - x*0.1", End)
smaller = SmallerThan(FirstNumber=crv_cp.Distance, SecondNumber=dedomain.Start)  # -> SmallerThan, OrEqualTo
larger = LargerThan(FirstNumber=crv_cp.Distance, SecondNumber=dedomain.End)  # -> LargerThan, OrEqualTo

# ---- group: Furthest Crvs
cull = CullPattern(List=debrep.Edges, CullPattern=larger.OrEqualTo)
join = JoinCurves(Curves=cull, Preserve=False)

# ---- group: Closest Crvs
cull_2 = CullPattern(List=debrep.Edges, CullPattern=smaller.OrEqualTo)
join_2 = JoinCurves(Curves=cull_2, Preserve=False)

# ----
C_2 = ClusterOutput(join)
C_3 = ClusterOutput(join_2)

# ==== cluster Cluster_3
B = ClusterInput()
C = ClusterInput()
debrep = DeconstructBrep(Brep=B)  # -> Faces, Edges, Vertices
curvepoint = PointOnCurve(debrep.Edges, parameter=0.5)
crv_cp = CurveClosestPoint(Point=curvepoint, Curve=C)  # -> Point, Parameter, Distance
bnd = Bounds(Numbers=crv_cp.Distance)
dedomain = DeconstructDomain(Domain=bnd)  # -> expr("x + x*0.2", Start), End
smaller = SmallerThan(FirstNumber=crv_cp.Distance, SecondNumber=dedomain.Start)  # -> SmallerThan, OrEqualTo
invbool = InvertBoolean(Boolean=smaller.OrEqualTo)  # -> Inverted, Number

# ---- group: Front Crvs
cull = CullPattern(List=debrep.Edges, CullPattern=smaller.OrEqualTo)
join = JoinCurves(Curves=cull, Preserve=False)

# ---- group: Rest of the Crvs
cull_2 = CullPattern(List=debrep.Edges, CullPattern=invbool.Inverted)

# ----
C_2 = ClusterOutput(join)
L = ClusterOutput(cull_2)
