# Grasshopper definition wh_shp_generating_0312 [Mar-18 '24, 1652].gh (Grasshopper 1.0.7)
# plug-ins: Bifocals, ChopChop, Pufferfish, Moonlight

poi = FilePath("F:\ScientificDatabase\BBBike\wuhan_bbike_test_shape\points.shx")
roads = FilePath("F:\ScientificDatabase\BBBike\wuhan_bbike_test_shape\roads.shx")
buildings = FilePath("F:\ScientificDatabase\BBBike\wuhan_bbike_test_shape\buildings.shx")
chopchop = ChopChop()
moonlight = Moonlight(Mode=Toggle(False))
roads_2 = ImportSHP(File=roads)  # -> Points, Curves, Regions
poi_2 = ImportSHP(File=poi)  # -> Points, Curves, Regions
buildings_2 = ImportSHP(File=buildings)  # -> Points, Curves, Regions
tree = GraftTree(Tree=buildings_2.Curves, IncludeEmptyLists=True, IncludeNullItems=True)

div = Slider(5, range=1..10)
divide_curve = DivideCurve(Curve=buildings_2.Curves, Count=div, Kinks=False)  # -> Points, Tangents, Parameters
point = Point(divide_curve.Points)

scale = Scale(Geometry=buildings_2.Curves, Center=Point(0, 0, 0), Factor=Slider(10000, range=0..100000000))  # -> Geometry, Transform
length = Length(Curve=roads_2.Curves)
flip_curve = FlipCurve(Curve=roads_2.Curves)  # -> Curve, Flag
bd_area = BoundarySurfaces(Edges=tree)
panel = Panel(length)
preview = CustomPreview(Geometry=scale.Geometry, Material=ColourSwatch(SwatchColor=RGB(255, 255, 7)))
surfaces = Panel(bd_area)
unit_z = UnitZ(Factor=bd_area)
unit_vector = Panel(unit_z)
offset_surface = OffsetSurface(Surface=bd_area, Distance="1000", BothSides=False, CreateSolid=True)
offsets = Panel(offset_surface)
