# Grasshopper definition Space Syntax for Generative Architectural Design.gh (Grasshopper 1.0.7)
# plug-ins: SpaceSyntaxDesign_GH, ChopChop, Moonlight

panel = Panel("""Lobby
Living
Ha11
Corridor
Bed1
Bed2
WC
Bath
Restroom
Library
Kitchen""")
gene_pool = GenePool(
    Decimals=2,
    Maximum=18,
    Minimum=2,
    Value=[7.595980966, 6.810414441, 7.403083331, 7.413278325, 7.29513221, 7.621501297, 12.2272665, 16.71775953, 3.09839592, 14.43031868, 13.02549041])
moonlight = Moonlight(Mode=Toggle(False))
chopchop = ChopChop()
point = Point([<point referenced from the Rhino model> x11])
curve = Curve([<curve referenced from the Rhino model> x15])
# https://www.youtube.com/watch?v=SgTiGKkDD0U&list=PLacLD_9JCeBlhH2wgae7BGV-Krvs4dy1k
# 
# https://www.bilibili.com/video/BV15A411b7fz/?spm_id_from=333.337.search-card.all.click&vd_source=51fce7bb620ac36682fc7251d41d07f8
graphfromnodes_links = GraphFromNodesLinks(Points=point, Links=curve, Labels=panel, Areas=gene_pool, TotalArea=Slider(180, range=0..1000))  # -> Graph, GraphVertices, Attributes
panel_2 = Panel(graphfromnodes_links.Graph)
panel_3 = Panel(graphfromnodes_links.GraphVertices)
forcedirecteddrawing = ForceDirectedDrawing(
    Graph=graphfromnodes_links.Graph,
    Vertices=graphfromnodes_links.GraphVertices,
    Attributes=graphfromnodes_links.Attributes,
    AttractionStrength=0.25,
    RepulsionStrength=1.4,
    ConvergenceTolearnce=0.001,
    MaximumIterations=4000,
    Active=Toggle(True))  # -> NewGraphVertices, IterationCount
panel_4 = Panel(graphfromnodes_links.Attributes)
data = Data(graphfromnodes_links.Graph)
data_2 = Data(graphfromnodes_links.Attributes)
integration_analysis = IntegrationAnalysis(Graph=data, Attributes=data_2)  # -> DepthTable, DepthMap, RelativeASymetry, Integration, IntegrationRelativeColors, IntegrationTags
entropy_analysis = EntropyAnalysis(Graph=data, Attributes=data_2, DepthTable=integration_analysis.DepthTable, DepthMap=integration_analysis.DepthMap)  # -> Entropy, EntropyRelativeColors, EntropyTags
control_analysis = ControlAnalysis(Graph=data, Attributes=data_2)  # -> Control, ControlRelativeColors, ControlTags
choice_analysis = ChoiceAnalysis(Graph=data, Attributes=data_2)  # -> ShortestPaths, ChoiceBetweenness, ChoiceRelativeColors, ChoiceTags
programme = Programme(Attributes=data_2)  # -> Tags, Areas, Colors, Legends
piechart = PieChart(Plane=PlaneXY(103.0623711, 47.22844861, 0), Attributes=data_2, Radius=10)
diskographdrawing = DiskoGraphDrawing(
    Plane=PlaneXY(102.4720972, 17.55627283, 0),
    Graph=graphfromnodes_links.Graph,
    Vertices=forcedirecteddrawing.NewGraphVertices,
    Attributes=graphfromnodes_links.Attributes,
    Thickness=Slider(5, range=0..10))
sort_list = SortList(
    Keys=integration_analysis.Integration,
    ValuesValuesA=integration_analysis.IntegrationRelativeColors,
    ValuesA=integration_analysis.IntegrationTags)  # -> Keys, ValuesValuesA, ValuesA
sort_list_2 = SortList(Keys=control_analysis.Control, ValuesA=control_analysis.ControlRelativeColors, ValuesB=control_analysis.ControlTags)  # -> Keys, ValuesA, ValuesB
sort_list_3 = SortList(Keys=entropy_analysis.Entropy, ValuesA=entropy_analysis.EntropyRelativeColors, ValuesB=entropy_analysis.EntropyTags)  # -> Keys, ValuesA, ValuesB
sort_list_4 = SortList(Keys=choice_analysis.ChoiceBetweenness, ValuesA=choice_analysis.ChoiceRelativeColors, ValuesB=choice_analysis.ChoiceTags)  # -> Keys, ValuesA, ValuesB
mass_addition = MassAddition(Input=programme.Areas)  # -> Result, PartialResults
legend = Legend(Colour=sort_list.ValuesValuesA, Tags=sort_list.ValuesA, LegendType=1)
legend_2 = Legend(Colour=sort_list_2.ValuesA, Tags=sort_list_2.ValuesB, LegendType=1)
legend_3 = Legend(Colour=sort_list_3.ValuesA, Tags=sort_list_3.ValuesB, LegendType=1)
legend_4 = Legend(Colour=sort_list_4.ValuesA, Tags=sort_list_4.ValuesB, LegendType=1)
legend_5 = Legend(Colour=programme.Colors, Tags=programme.Legends, LegendType=1)
justifiedgraphdrawing = JustifiedGraphDrawing(
    ViewPointIndex=Slider(5, range=0..10),
    Plane=PlaneXY(150.2781318, 11.02890299, 0),
    Size=Slider(7, range=0..10),
    Thickness=Slider(5, range=0..10),
    Graph=data,
    Attributes=data_2,
    DepthTable=integration_analysis.DepthTable)
